# Grasshopper definition COMPAS_AR4_Base_v-1.gh (Grasshopper 1.0.8)

button = Button()
path = FilePath("C:\Users\pdanahy3\Documents\AR4_URDF\ar4_compas_package_track.urdf")
path_2 = FilePath("C:\Users\pdanahy3\Documents\AR4_URDF\")
ai_rlab_loadrobot = Python3Script(URDF=path, PackageRoot=path_2, Load=Toggle(True), Reload=button)  # -> robot_name, robot_model, joint_names, link_names, cache_id, mesh_link_names, mesh_count, status
# ---------- ai_rlab_loadrobot: Python ----------
#! python3
# r: compas
# r: compas_fab
# r: compas_robots

import Rhino.Geometry as rg

from compas_robots import RobotModel
from compas_robots.resources import LocalPackageMeshLoader

try:
    import scriptcontext as sc
except Exception:
    sc = None


# ------------------------------------------------------------
# Helpers
# ------------------------------------------------------------

def unwrap_gh(value):
    if value is None:
        return None
    if hasattr(value, "Value"):
        return value.Value
    return value


def to_bool(value, default=False):
    value = unwrap_gh(value)

    if value is None:
        return default

    if isinstance(value, bool):
        return value

    s = str(value).strip().lower()
    return s in ["true", "1", "yes", "y"]


def frame_to_plane(frame):
    if frame is None:
        return rg.Plane.WorldXY

    p = frame.point
    x = frame.xaxis
    y = frame.yaxis

    return rg.Plane(
        rg.Point3d(float(p.x), float(p.y), float(p.z)),
        rg.Vector3d(float(x.x), float(x.y), float(x.z)),
        rg.Vector3d(float(y.x), float(y.y), float(y.z))
    )


def compas_mesh_to_rhino_mesh(cmesh):
    """Convert a COMPAS mesh to a Rhino mesh."""

    rmesh = rg.Mesh()
    vertex_index = {}

    for i, vkey in enumerate(cmesh.vertices()):
        x, y, z = cmesh.vertex_coordinates(vkey)
        rmesh.Vertices.Add(float(x), float(y), float(z))
        vertex_index[vkey] = i

    for fkey in cmesh.faces():
        face_vertices = [vertex_index[vkey] for vkey in cmesh.face_vertices(fkey)]

        if len(face_vertices) == 3:
            rmesh.Faces.AddFace(
                face_vertices[0],
                face_vertices[1],
                face_vertices[2]
            )

        elif len(face_vertices) == 4:
            rmesh.Faces.AddFace(
                face_vertices[0],
                face_vertices[1],
                face_vertices[2],
                face_vertices[3]
            )

        elif len(face_vertices) > 4:
            # Triangulate n-gons as a simple fan.
            a = face_vertices[0]
            for j in range(1, len(face_vertices) - 1):
                rmesh.Faces.AddFace(a, face_vertices[j], face_vertices[j + 1])

    rmesh.Normals.ComputeNormals()
    rmesh.Compact()

    return rmesh


def get_visuals(link):
    """Return link visuals robustly as a list."""

    visuals = getattr(link, "visual", [])

    if visuals is None:
        return []

    if isinstance(visuals, list):
        return visuals

    try:
        return list(visuals)
    except Exception:
        return [visuals]


def get_shape_meshes(shape):
    """Return COMPAS meshes from a URDF shape object robustly."""

    if shape is None:
        return []

    meshes = getattr(shape, "meshes", None)

    if meshes is not None:
        try:
            return list(meshes)
        except Exception:
            return [meshes]

    # Fallback if the shape itself behaves like a mesh.
    if hasattr(shape, "vertices") and hasattr(shape, "faces"):
        return [shape]

    return []


def visual_to_local_rhino_meshes(visual):
    """
    Convert one URDF visual into Rhino meshes in link-local coordinates.

    The visual's own origin is baked into the cached mesh. Later, Component B
    only needs to transform from WorldXY to the current link frame.
    """

    if visual is None:
        return []

    geometry = getattr(visual, "geometry", None)
    if geometry is None:
        return []

    shape = getattr(geometry, "shape", None)
    if shape is None:
        return []

    cmeshes = get_shape_meshes(shape)
    if not cmeshes:
        return []

    visual_origin = getattr(visual, "origin", None)

    if visual_origin:
        local_plane = frame_to_plane(visual_origin)
        local_xform = rg.Transform.PlaneToPlane(rg.Plane.WorldXY, local_plane)
    else:
        local_xform = None

    rhino_meshes = []

    for cmesh in cmeshes:
        rmesh = compas_mesh_to_rhino_mesh(cmesh)

        if local_xform:
            rmesh.Transform(local_xform)

        rhino_meshes.append(rmesh)

    return rhino_meshes


# ------------------------------------------------------------
# Defaults
# ------------------------------------------------------------

cache_id = None
robot_model = None
robot_name = None
joint_names = []
link_names = []
mesh_link_names = []
mesh_count = 0
status = ""


# ------------------------------------------------------------
# Main
# ------------------------------------------------------------

try:
    if sc is None:
        raise Exception("scriptcontext is not available. This cache method requires Rhino/Grasshopper.")

    load = to_bool(Load, False)
    reload = to_bool(Reload, False)

    urdf_path = str(unwrap_gh(URDF)).strip()
    package_root = str(unwrap_gh(PackageRoot)).strip()

    if not urdf_path:
        raise Exception("URDF input is empty.")

    if not package_root:
        raise Exception("PackageRoot input is empty.")

    cache_id = "AR4_CACHE::{}::{}".format(urdf_path, package_root)

    model_key = cache_id + "::model"
    meshes_key = cache_id + "::meshes"

    cached_model = sc.sticky.get(model_key, None)
    cached_meshes = sc.sticky.get(meshes_key, None)

    if not load:
        if cached_model is not None and cached_meshes is not None:
            robot_model = cached_model
            robot_name = robot_model.name
            joint_names = robot_model.get_configurable_joint_names()
            link_names = [link.name for link in robot_model.links]
            mesh_link_names = list(cached_meshes.keys())
            mesh_count = sum(len(cached_meshes[name]) for name in mesh_link_names)
            status = "Load is False. Using existing cached robot."
        else:
            status = "Load is False and no cached robot exists."

    else:
        if reload or cached_model is None or cached_meshes is None:

            # ------------------------------------------------------------
            # Load robot model
            # ------------------------------------------------------------

            model = RobotModel.from_urdf_file(urdf_path)

            loader = LocalPackageMeshLoader(
                package_root,
                "annin_ar4_description"
            )

            model.load_geometry(loader)

            # ------------------------------------------------------------
            # Convert all visual link meshes once
            # ------------------------------------------------------------

            mesh_cache = {}

            for link in model.links:
                link_meshes = []

                for visual in get_visuals(link):
                    link_meshes.extend(visual_to_local_rhino_meshes(visual))

                if link_meshes:
                    mesh_cache[link.name] = link_meshes

            # Store in Rhino/Grasshopper sticky cache.
            sc.sticky[model_key] = model
            sc.sticky[meshes_key] = mesh_cache

            status = "Loaded URDF and cached link-local Rhino meshes."

        else:
            model = cached_model
            mesh_cache = cached_meshes
            status = "Using cached robot model and cached Rhino meshes."

        robot_model = model
        robot_name = model.name
        joint_names = model.get_configurable_joint_names()
        link_names = [link.name for link in model.links]
        mesh_link_names = list(mesh_cache.keys())
        mesh_count = sum(len(mesh_cache[name]) for name in mesh_link_names)

        status += " Name: {} | links: {} | configurable joints: {} | mesh links: {} | meshes: {}".format(
            robot_name,
            len(link_names),
            len(joint_names),
            len(mesh_link_names),
            mesh_count
        )

except Exception as e:
    cache_id = None
    robot_model = None
    robot_name = None
    joint_names = []
    link_names = []
    mesh_link_names = []
    mesh_count = 0
    status = "ERROR: {}".format(e)
# ---------- end ai_rlab_loadrobot ----------
merge = Merge(
    Data1=Slider(16, range=-180..180),
    Data2=Slider(-35, range=-180..180),
    Data3=Slider(27, range=-180..180),
    Data4=Slider(-23, range=-180..180),
    Data5=Slider(-13, range=-180..180),
    Data6=Slider(-70, range=-180..180))
rad = Radians(Degrees=merge)
panel = Panel(ai_rlab_loadrobot.cache_id)
ai_rlab_robotsim = Python3Script(
    robot_model=ai_rlab_loadrobot.robot_model,
    cache_id=ai_rlab_loadrobot.cache_id,
    TrackM=Slider(1, range=0..1),
    JointValues=rad,
    ToolZ=".1",
    DrawMeshes=Toggle(True),
    DrawSkeleton=Toggle(True),
    DrawTrackProxy=Toggle(True))  # -> motion_joint_names, joint_config, robot_geometry, track_geometry, skeleton_lines, link_planes, ee_plane, tcp_plane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; inputs JointValues: list of Double, ToolZ: Double, DrawMeshes: Boolean
# ---------- ai_rlab_robotsim: Python ----------
#! python3
# r: compas
# r: compas_fab
# r: compas_robots

import math
import Rhino.Geometry as rg

from compas.geometry import Frame
from compas.geometry import Point

try:
    import scriptcontext as sc
except Exception:
    sc = None


# ------------------------------------------------------------
# Helpers
# ------------------------------------------------------------

def unwrap_gh(value):
    if value is None:
        return None
    if hasattr(value, "Value"):
        return value.Value
    return value


def to_bool(value, default=False):
    value = unwrap_gh(value)

    if value is None:
        return default

    if isinstance(value, bool):
        return value

    return str(value).strip().lower() in ["true", "1", "yes", "y"]


def to_float(value, default=0.0):
    value = unwrap_gh(value)

    if value is None:
        return default

    if isinstance(value, (int, float)):
        return float(value)

    try:
        return float(str(value).strip())
    except Exception:
        return default


def to_float_list(values):
    if values is None:
        return []

    values = unwrap_gh(values)

    if isinstance(values, str):
        raw = (
            values.replace(",", "\n")
                  .replace(";", "\n")
                  .replace("\t", "\n")
                  .splitlines()
        )
        return [to_float(v) for v in raw if str(v).strip()]

    try:
        raw = list(values)
    except TypeError:
        raw = [values]

    result = []

    for item in raw:
        item = unwrap_gh(item)

        if isinstance(item, str) and ("\n" in item or "," in item or ";" in item):
            subitems = (
                item.replace(",", "\n")
                    .replace(";", "\n")
                    .replace("\t", "\n")
                    .splitlines()
            )
            result.extend([to_float(v) for v in subitems if str(v).strip()])
        else:
            result.append(to_float(item))

    return result


def frame_to_plane(frame):
    p = frame.point
    x = frame.xaxis
    y = frame.yaxis

    return rg.Plane(
        rg.Point3d(float(p.x), float(p.y), float(p.z)),
        rg.Vector3d(float(x.x), float(x.y), float(x.z)),
        rg.Vector3d(float(y.x), float(y.y), float(y.z))
    )


def frame_point(frame):
    p = frame.point
    return rg.Point3d(float(p.x), float(p.y), float(p.z))


def safe_fk(model, config, link_name):
    try:
        return model.forward_kinematics(config, link_name=link_name)
    except Exception:
        return None


def link_ref_name(value):
    if value is None:
        return None

    if isinstance(value, str):
        return value

    if hasattr(value, "link"):
        return value.link

    if hasattr(value, "name"):
        return value.name

    return str(value)


def make_box_at_plane(base_plane, center_xyz, size_xyz):
    cx, cy, cz = center_xyz
    sx, sy, sz = size_xyz

    center = (
        base_plane.Origin
        + base_plane.XAxis * cx
        + base_plane.YAxis * cy
        + base_plane.ZAxis * cz
    )

    plane = rg.Plane(base_plane)
    plane.Origin = center

    box = rg.Box(
        plane,
        rg.Interval(-sx / 2.0, sx / 2.0),
        rg.Interval(-sy / 2.0, sy / 2.0),
        rg.Interval(-sz / 2.0, sz / 2.0)
    )

    return box.ToBrep()


# ------------------------------------------------------------
# Defaults
# ------------------------------------------------------------

motion_joint_names = [
    "track_joint",
    "joint_1",
    "joint_2",
    "joint_3",
    "joint_4",
    "joint_5",
    "joint_6"
]

joint_config = {}
robot_geometry = []
track_geometry = []
skeleton_lines = []
link_planes = []
ee_plane = None
tcp_plane = None
ee_frame = None
tcp_frame = None
status = ""


# ------------------------------------------------------------
# Main
# ------------------------------------------------------------

try:
    if sc is None:
        raise Exception("scriptcontext is not available.")

    cid = str(unwrap_gh(cache_id) or "").strip()

    if not cid or cid == "None":
        raise Exception("No cache_id. Connect cache_id from Component A directly.")

    model = sc.sticky.get(cid + "::model", None)
    mesh_cache = sc.sticky.get(cid + "::meshes", None)

    if model is None:
        raise Exception("No cached robot model found. Run Component A with Load=True.")

    if mesh_cache is None:
        mesh_cache = {}

    # ------------------------------------------------------------
    # 1. Build named 7-axis configuration
    # ------------------------------------------------------------

    track_m = to_float(TrackM, 0.0)

    # Hard clamp to the 1 m track range.
    if track_m < 0.0:
        track_m = 0.0

    if track_m > 1.0:
        track_m = 1.0

    robot_joint_values = to_float_list(JointValues)

    while len(robot_joint_values) < 6:
        robot_joint_values.append(0.0)

    robot_joint_values = robot_joint_values[:6]

    config = model.zero_configuration()

    if "track_joint" in model.get_configurable_joint_names():
        config["track_joint"] = track_m

    for i in range(6):
        name = "joint_{}".format(i + 1)

        if name in model.get_configurable_joint_names():
            config[name] = robot_joint_values[i]

        joint_config[name] = robot_joint_values[i]

    joint_config["track_joint"] = track_m

    # Keep gripper closed/static if present.
    if "gripper_jaw1_joint" in model.get_configurable_joint_names():
        config["gripper_jaw1_joint"] = 0.0

    # ------------------------------------------------------------
    # 2. Compute link frames
    # ------------------------------------------------------------

    all_link_names = [link.name for link in model.links]
    frame_by_link = {}

    for name in all_link_names:
        f = safe_fk(model, config, name)
        if f is not None:
            frame_by_link[name] = f
            link_planes.append(frame_to_plane(f))

    # ------------------------------------------------------------
    # 3. End-effector and TCP
    # ------------------------------------------------------------

    if "tool0" in frame_by_link:
        ee_frame = frame_by_link["tool0"]
    elif "pneumatic_gripper_tool_link" in frame_by_link:
        ee_frame = frame_by_link["pneumatic_gripper_tool_link"]
    elif "ee_link" in frame_by_link:
        ee_frame = frame_by_link["ee_link"]
    elif "link_6" in frame_by_link:
        ee_frame = frame_by_link["link_6"]
    else:
        ee_frame = model.forward_kinematics(config)

    tool_z_value = to_float(ToolZ, 0.0)

    p = ee_frame.point
    z = ee_frame.zaxis

    tcp_point = Point(
        p.x + z.x * tool_z_value,
        p.y + z.y * tool_z_value,
        p.z + z.z * tool_z_value
    )

    tcp_frame = Frame(
        tcp_point,
        ee_frame.xaxis,
        ee_frame.yaxis
    )

    ee_plane = frame_to_plane(ee_frame)
    tcp_plane = frame_to_plane(tcp_frame)

    # ------------------------------------------------------------
    # 4. Move cached AR4 meshes
    # ------------------------------------------------------------

    if to_bool(DrawMeshes, True):

        for link_name, local_meshes in mesh_cache.items():

            if link_name not in frame_by_link:
                continue

            link_plane = frame_to_plane(frame_by_link[link_name])
            xform = rg.Transform.PlaneToPlane(rg.Plane.WorldXY, link_plane)

            for base_mesh in local_meshes:
                moved_mesh = base_mesh.DuplicateMesh()
                moved_mesh.Transform(xform)
                robot_geometry.append(moved_mesh)

    # ------------------------------------------------------------
    # 5. Draw simple track proxy geometry
    # ------------------------------------------------------------

    if to_bool(DrawTrackProxy, True):

        if "track_base_link" in frame_by_link:
            track_base_plane = frame_to_plane(frame_by_link["track_base_link"])
        else:
            track_base_plane = rg.Plane.WorldXY

        if "track_carriage_link" in frame_by_link:
            carriage_plane = frame_to_plane(frame_by_link["track_carriage_link"])
        else:
            carriage_plane = rg.Plane.WorldXY

        # Rail: 1.05 m long, drawn slightly below robot base.
        rail = make_box_at_plane(
            track_base_plane,
            (0.5, 0.0, -0.04),
            (1.05, 0.08, 0.05)
        )

        # Carriage: moves with track_joint.
        carriage = make_box_at_plane(
            carriage_plane,
            (0.0, 0.0, -0.005),
            (0.14, 0.14, 0.07)
        )

        track_geometry.append(rail)
        track_geometry.append(carriage)

    # ------------------------------------------------------------
    # 6. Optional skeleton display
    # ------------------------------------------------------------

    if to_bool(DrawSkeleton, False):

        for joint in model.joints:
            parent_name = link_ref_name(getattr(joint, "parent", None))
            child_name = link_ref_name(getattr(joint, "child", None))

            if parent_name in frame_by_link and child_name in frame_by_link:
                p0 = frame_point(frame_by_link[parent_name])
                p1 = frame_point(frame_by_link[child_name])

                if p0.DistanceTo(p1) > 1e-9:
                    skeleton_lines.append(rg.Line(p0, p1))

    status = (
        "7-axis pose updated | "
        "track_joint: {:.3f} m | "
        "J7 command equivalent: {:.1f} mm | "
        "robot meshes: {} | "
        "track proxy objects: {}"
    ).format(
        track_m,
        track_m * 1000.0,
        len(robot_geometry),
        len(track_geometry)
    )

except Exception as e:
    motion_joint_names = [
        "track_joint",
        "joint_1",
        "joint_2",
        "joint_3",
        "joint_4",
        "joint_5",
        "joint_6"
    ]
    joint_config = {}
    robot_geometry = []
    track_geometry = []
    skeleton_lines = []
    link_planes = []
    ee_plane = None
    tcp_plane = None
    ee_frame = None
    tcp_frame = None
    status = "ERROR: {}".format(e)
# ---------- end ai_rlab_robotsim ----------
mesh = Mesh(ai_rlab_robotsim.robot_geometry)
crv = Curve(ai_rlab_robotsim.skeleton_lines)
pln = Plane(ai_rlab_robotsim.tcp_plane)
panel_2 = Panel(ai_rlab_robotsim.status)

mesh_2 = Mesh(ai_rlab_robotsim.track_geometry)
panel_3 = Panel("RJA0.000B0.000C0.000D0.000E0.000F0.000J7100.000J80.000J90.000Sm5.000Ac5.000Dc5.000Rm10.000WFLm000000")
panel_4 = Panel("TL")

panel_5 = Panel("HO")
panel_6 = Panel("RP")
or = GateOr(A=button, B=Toggle(True))
ai_rlab_runrobot = Python3Script(Port="COM4", Baud="9600", Command=panel_3, Send=Toggle(True))  # -> sent, reply_lines, raw_reply, status
# ---------- ai_rlab_runrobot: Python ----------
#! python3
# r: pyserial

import time

try:
    import scriptcontext as sc
except Exception:
    sc = None


# ------------------------------------------------------------
# Helpers
# ------------------------------------------------------------

def unwrap_gh(value):
    if value is None:
        return None
    if hasattr(value, "Value"):
        return value.Value
    return value


def to_bool(value, default=False):
    value = unwrap_gh(value)

    if value is None:
        return default

    if isinstance(value, bool):
        return value

    return str(value).strip().lower() in ["true", "1", "yes", "y"]


# ------------------------------------------------------------
# Defaults
# ------------------------------------------------------------

sent = None
reply_lines = []
raw_reply = ""
status = ""


# ------------------------------------------------------------
# Main
# ------------------------------------------------------------

try:
    import serial

    port = str(unwrap_gh(Port)).strip()
    baud = int(float(unwrap_gh(Baud) or 9600))
    command = str(unwrap_gh(Command) or "HO").strip()
    send = to_bool(Send, False)

    if not port:
        status = "No Port provided."

    elif not command:
        status = "No Command provided."

    else:
        # Use a sticky flag so Grasshopper sends only once
        # when the Send toggle changes from False to True.
        edge_key = "AR4_SERIAL_TEST_LAST_SEND_STATE"
        previous_send = sc.sticky.get(edge_key, False) if sc else False

        if sc:
            sc.sticky[edge_key] = send

        if not send:
            status = "Ready. Set Send=True to send {} to {}.".format(command, port)

        elif previous_send:
            status = "Send is still True. Not sending again. Toggle Send False, then True to resend."

        else:
            # Open serial port.
            ser = serial.Serial(
                port=port,
                baudrate=baud,
                timeout=2.0,
                write_timeout=2.0
            )

            # Give the Teensy serial connection time to settle.
            time.sleep(2.0)

            # Clear any old buffered data.
            try:
                ser.reset_input_buffer()
                ser.reset_output_buffer()
            except Exception:
                pass

            # Firmware expects newline-terminated command.
            wire_command = command + "\n"

            ser.write(wire_command.encode("utf-8"))
            ser.flush()

            sent = wire_command

            # Read for up to 2 seconds.
            start = time.time()
            buffer = ""

            while time.time() - start < 2.0:
                if ser.in_waiting > 0:
                    data = ser.read(ser.in_waiting)
                    text = data.decode("utf-8", errors="ignore")
                    buffer += text

                    # Stop after receiving a line.
                    if "\n" in buffer:
                        break

                time.sleep(0.02)

            ser.close()

            raw_reply = buffer
            reply_lines = [line.strip() for line in buffer.splitlines() if line.strip()]

            if reply_lines:
                status = "Success. Sent {} to {} at {} baud.".format(
                    command,
                    port,
                    baud
                )
            else:
                status = "Sent {}, but no reply received. Check firmware state, AR4 software/Arduino monitor, and terminator.".format(
                    command
                )

except Exception as e:
    sent = None
    reply_lines = []
    raw_reply = ""
    status = "ERROR: {}".format(e)
# ---------- end ai_rlab_runrobot ----------
ai_rlab_serialconnection = Python3Script(Refresh=or)  # -> ports, status
# ---------- ai_rlab_serialconnection: Python ----------
#! python3
# r: pyserial

ports = []
status = ""

try:
    import serial.tools.list_ports

    if Refresh:
        port_infos = serial.tools.list_ports.comports()

        for p in port_infos:
            ports.append("{} | {} | {}".format(p.device, p.description, p.hwid))

        status = "Found {} serial ports.".format(len(ports))
    else:
        status = "Refresh is False."

except Exception as e:
    ports = []
    status = "ERROR: {}".format(e)
# ---------- end ai_rlab_serialconnection ----------
panel_7 = Panel(ai_rlab_runrobot.sent)
panel_8 = Panel(ai_rlab_serialconnection.status)
panel_9 = Panel(ai_rlab_runrobot.reply_lines)
panel_10 = Panel(ai_rlab_serialconnection.ports)
panel_11 = Panel(ai_rlab_runrobot.raw_reply)
panel_12 = Panel(ai_rlab_runrobot.status)

number_slider = Slider(0, range=0..100)
merge_2 = Merge(
    Data1=Slider(0, range=0..100),
    Data2=Slider(0, range=0..100),
    Data3=Slider(0, range=0..100),
    Data4=Slider(0, range=0..100),
    Data5=Slider(0, range=0..100),
    Data6=Slider(0, range=0..100))
ai_rlab_rpparser = Python3Script(RPReply=ai_rlab_runrobot.raw_reply)  # -> joint_values_deg, joint_values_rad, catersian_pose, external_axes_mm, j7_mm, track_m, status
# ---------- ai_rlab_rpparser: Python ----------
#! python3

import math


# ------------------------------------------------------------
# Helpers
# ------------------------------------------------------------

def unwrap_gh(value):
    if value is None:
        return None
    if hasattr(value, "Value"):
        return value.Value
    return value


def to_float(value, default=0.0):
    value = unwrap_gh(value)

    if value is None:
        return default

    try:
        return float(value)
    except Exception:
        try:
            return float(str(value).strip())
        except Exception:
            return default


def clean_reply(value):
    value = unwrap_gh(value)

    if value is None:
        return ""

    # If a Grasshopper list is passed, search for the RP-looking line.
    if not isinstance(value, str):
        try:
            items = list(value)

            for item in items:
                s = str(unwrap_gh(item)).strip()

                if s.startswith("A") and "B" in s and "C" in s and "P" in s:
                    return s

        except Exception:
            pass

    # Otherwise treat it as raw text.
    s = str(value).strip()

    # If raw reply contains multiple lines, find the RP-looking line.
    for line in s.splitlines():
        line = line.strip()

        if line.startswith("A") and "B" in line and "C" in line and "P" in line:
            return line

    return s


def between(s, start_token, end_token=None):
    start = s.find(start_token)

    if start < 0:
        return ""

    start += len(start_token)

    if end_token is None:
        return s[start:].strip()

    end = s.find(end_token, start)

    if end < 0:
        return s[start:].strip()

    return s[start:end].strip()


def clamp(value, low, high):
    if value < low:
        return low

    if value > high:
        return high

    return value


# ------------------------------------------------------------
# Outputs
# ------------------------------------------------------------

joint_values_deg = []
joint_values_rad = []
cartesian_pose = []
external_axes_mm = []
j7_mm = 0.0
track_m = 0.0
status = ""


# ------------------------------------------------------------
# Main
# ------------------------------------------------------------

try:
    rp = clean_reply(RPReply)

    if not rp:
        status = "No RPReply provided. Send RP first, then wire raw_reply into this parser."

    elif not rp.startswith("A"):
        status = "Input does not look like an RP reply: {}".format(rp)

    else:
        # A-F = robot joint angles in degrees
        A = to_float(between(rp, "A", "B"))
        B = to_float(between(rp, "B", "C"))
        C = to_float(between(rp, "C", "D"))
        D = to_float(between(rp, "D", "E"))
        E = to_float(between(rp, "E", "F"))
        F = to_float(between(rp, "F", "G"))

        joint_values_deg = [A, B, C, D, E, F]
        joint_values_rad = [math.radians(v) for v in joint_values_deg]

        # G-L = Cartesian pose
        X = to_float(between(rp, "G", "H"))
        Y = to_float(between(rp, "H", "I"))
        Z = to_float(between(rp, "I", "J"))

        Rz = to_float(between(rp, "J", "K"))
        Ry = to_float(between(rp, "K", "L"))
        Rx = to_float(between(rp, "L", "M"))

        cartesian_pose = [X, Y, Z, Rz, Ry, Rx]

        # P/Q/R = external axes
        # P is firmware J7, in mm for the track
        P = to_float(between(rp, "P", "Q"))
        Q = to_float(between(rp, "Q", "R"))
        R = to_float(between(rp, "R", None))

        external_axes_mm = [P, Q, R]

        j7_mm = P

        # Inverted track mapping:
        # Firmware J7 = 0 mm means close to motor / home side.
        # Grasshopper TrackM = 1.0 means close to motor / home side.
        # Firmware J7 = 1000 mm means far from motor.
        # Grasshopper TrackM = 0.0 means far from motor.
        track_m = 1.0 - (j7_mm / 1000.0)
        track_m = clamp(track_m, 0.0, 1.0)

        status = (
            "Parsed RP successfully | "
            "J7 firmware = {:.3f} mm | "
            "TrackM inverted = {:.4f}"
        ).format(
            j7_mm,
            track_m
        )

except Exception as e:
    joint_values_deg = []
    joint_values_rad = []
    cartesian_pose = []
    external_axes_mm = []
    j7_mm = 0.0
    track_m = 0.0
    status = "ERROR: {}".format(e)
# ---------- end ai_rlab_rpparser ----------
ai_rlab_programcommand = Python3Script(
    RPReply=ai_rlab_runrobot.raw_reply,
    TrackM=Slider(0.1, range=0..1),
    JointValues=merge_2,
    Speed=Slider(5, range=0..100),
    Accel=Slider(5, range=0..100),
    Decel=Slider(5, range=0..100),
    Ramp=Slider(10, range=0..100),
    Wrist="F",
    LoopMode="000000",
    Build=Toggle(True))  # -> joint_values_deg, j7_mm, rj_command, status; inputs JointValues: list
# ---------- ai_rlab_programcommand: Python ----------
#! python3

import math


# ------------------------------------------------------------
# Helpers
# ------------------------------------------------------------

def unwrap_gh(value):
    if value is None:
        return None
    if hasattr(value, "Value"):
        return value.Value
    return value


def to_bool(value, default=False):
    value = unwrap_gh(value)

    if value is None:
        return default

    if isinstance(value, bool):
        return value

    return str(value).strip().lower() in ["true", "1", "yes", "y"]


def to_float(value, default=0.0):
    value = unwrap_gh(value)

    if value is None:
        return default

    if isinstance(value, (int, float)):
        return float(value)

    try:
        return float(str(value).strip())
    except Exception:
        return default


def to_float_list(values):
    if values is None:
        return []

    values = unwrap_gh(values)

    if isinstance(values, str):
        raw = (
            values.replace(",", "\n")
                  .replace(";", "\n")
                  .replace("\t", "\n")
                  .splitlines()
        )
        return [to_float(v) for v in raw if str(v).strip()]

    try:
        raw = list(values)
    except TypeError:
        raw = [values]

    result = []

    for item in raw:
        item = unwrap_gh(item)

        if isinstance(item, str) and ("\n" in item or "," in item or ";" in item):
            subitems = (
                item.replace(",", "\n")
                    .replace(";", "\n")
                    .replace("\t", "\n")
                    .splitlines()
            )
            result.extend([to_float(v) for v in subitems if str(v).strip()])
        else:
            result.append(to_float(item))

    return result


def to_text(value, default=""):
    value = unwrap_gh(value)

    if value is None:
        return default

    return str(value).strip()


# ------------------------------------------------------------
# Defaults
# ------------------------------------------------------------

rj_command = None
j7_mm = 0.0
joint_values_deg = []
status = ""


# ------------------------------------------------------------
# Main
# ------------------------------------------------------------

try:
    build = to_bool(Build, True)

    if not build:
        status = "Build is False."

    else:
        track_m = to_float(TrackM, 0.0)

        if track_m < 0.0:
            track_m = 0.0

        if track_m > 1.0:
            track_m = 1.0

        # Inverted firmware mapping:
        # TrackM = 0.0 means far from motor.
        # TrackM = 1.0 means close to motor / home switch.
        # Firmware J7 = 0 is motor-side after calibration.
        j7_mm = (1.0 - track_m) * 1000.0

        values = to_float_list(JointValues)

        while len(values) < 6:
            values.append(0.0)

        values = values[:6]

        angles_in_radians = to_bool(AnglesInRadians, True)

        if angles_in_radians:
            joint_values_deg = [math.degrees(v) for v in values]
        else:
            joint_values_deg = values

        j1, j2, j3, j4, j5, j6 = joint_values_deg

        speed = to_float(Speed, 5.0)
        accel = to_float(Accel, 5.0)
        decel = to_float(Decel, 5.0)
        ramp = to_float(Ramp, 10.0)

        wrist = to_text(Wrist, "F")
        if not wrist:
            wrist = "F"

        loop_mode = to_text(LoopMode, "000000")
        if not loop_mode:
            loop_mode = "000000"

        # RJ parser expects:
        # RJA...B...C...D...E...F...J7...J8...J9...S...Ac...Dc...Rm...W...Lm...
        rj_command = (
            "RJ"
            "A{j1:.3f}"
            "B{j2:.3f}"
            "C{j3:.3f}"
            "D{j4:.3f}"
            "E{j5:.3f}"
            "F{j6:.3f}"
            "J7{j7:.3f}"
            "J8{j8:.3f}"
            "J9{j9:.3f}"
            "Sm{speed:.3f}"
            "Ac{accel:.3f}"
            "Dc{decel:.3f}"
            "Rm{ramp:.3f}"
            "W{wrist}"
            "Lm{loop_mode}"
        ).format(
            j1=j1,
            j2=j2,
            j3=j3,
            j4=j4,
            j5=j5,
            j6=j6,
            j7=j7_mm,
            j8=0.0,
            j9=0.0,
            speed=speed,
            accel=accel,
            decel=decel,
            ramp=ramp,
            wrist=wrist,
            loop_mode=loop_mode
        )

        status = "Built 7-axis RJ command | TrackM {:.3f} → firmware J7 {:.1f} mm using inverted motor-side mapping.".format(
            track_m,
            j7_mm
        )

except Exception as e:
    rj_command = None
    j7_mm = 0.0
    joint_values_deg = []
    status = "ERROR: {}".format(e)
# ---------- end ai_rlab_programcommand ----------
ai_rlab_programjointcalibration = Python3Script(
    J1=Toggle(False),
    J2=Toggle(False),
    J3=Toggle(False),
    J4=Toggle(False),
    J5=Toggle(False),
    J6=Toggle(False),
    J7=Toggle(True),
    J8=Toggle(False),
    J9=Toggle(False),
    J1Offset=number_slider,
    J2Offset=number_slider,
    J3Offset=number_slider,
    J4Offset=number_slider,
    J5Offset=number_slider,
    J6Offset=number_slider,
    J7Offset=number_slider,
    J8Offset=number_slider,
    J9Offset=number_slider,
    Build=Toggle(True))  # -> ll_command, selected_joints, status
# ---------- ai_rlab_programjointcalibration: Python ----------
#! python3

# ------------------------------------------------------------
# Helpers
# ------------------------------------------------------------

def unwrap_gh(value):
    if value is None:
        return None
    if hasattr(value, "Value"):
        return value.Value
    return value


def to_bool(value, default=False):
    value = unwrap_gh(value)

    if value is None:
        return default

    if isinstance(value, bool):
        return value

    return str(value).strip().lower() in ["true", "1", "yes", "y"]


def to_int_flag(value):
    return 1 if to_bool(value, False) else 0


def to_float(value, default=0.0):
    value = unwrap_gh(value)

    if value is None:
        return default

    try:
        return float(value)
    except Exception:
        try:
            return float(str(value).strip())
        except Exception:
            return default


# ------------------------------------------------------------
# Defaults
# ------------------------------------------------------------

ll_command = None
selected_joints = []
status = ""


# ------------------------------------------------------------
# Main
# ------------------------------------------------------------

try:
    build = to_bool(Build, True)

    if not build:
        status = "Build is False."

    else:
        # Joint request flags.
        j1 = to_int_flag(J1)
        j2 = to_int_flag(J2)
        j3 = to_int_flag(J3)
        j4 = to_int_flag(J4)
        j5 = to_int_flag(J5)
        j6 = to_int_flag(J6)
        j7 = to_int_flag(J7)
        j8 = to_int_flag(J8)
        j9 = to_int_flag(J9)

        flags = [j1, j2, j3, j4, j5, j6, j7, j8, j9]

        for i, flag in enumerate(flags):
            if flag == 1:
                selected_joints.append("J{}".format(i + 1))

        # Calibration offset values in degrees/axis units.
        o1 = to_float(J1Offset, 0.0)
        o2 = to_float(J2Offset, 0.0)
        o3 = to_float(J3Offset, 0.0)
        o4 = to_float(J4Offset, 0.0)
        o5 = to_float(J5Offset, 0.0)
        o6 = to_float(J6Offset, 0.0)
        o7 = to_float(J7Offset, 0.0)
        o8 = to_float(J8Offset, 0.0)
        o9 = to_float(J9Offset, 0.0)

        # Firmware LL parser expects:
        # LL
        # A-B-C-D-E-F-G-H-I = joint request flags
        # J-K-L-M-N-O-P-Q-R = calibration offsets
        ll_command = (
            "LL"
            "A{j1}"
            "B{j2}"
            "C{j3}"
            "D{j4}"
            "E{j5}"
            "F{j6}"
            "G{j7}"
            "H{j8}"
            "I{j9}"
            "J{o1:.3f}"
            "K{o2:.3f}"
            "L{o3:.3f}"
            "M{o4:.3f}"
            "N{o5:.3f}"
            "O{o6:.3f}"
            "P{o7:.3f}"
            "Q{o8:.3f}"
            "R{o9:.3f}"
        ).format(
            j1=j1,
            j2=j2,
            j3=j3,
            j4=j4,
            j5=j5,
            j6=j6,
            j7=j7,
            j8=j8,
            j9=j9,
            o1=o1,
            o2=o2,
            o3=o3,
            o4=o4,
            o5=o5,
            o6=o6,
            o7=o7,
            o8=o8,
            o9=o9
        )

        if selected_joints:
            status = "Built LL calibration command for: {}".format(", ".join(selected_joints))
        else:
            status = "No joints selected. Command built, but it will not calibrate any joint."

except Exception as e:
    ll_command = None
    selected_joints = []
    status = "ERROR: {}".format(e)
# ---------- end ai_rlab_programjointcalibration ----------
panel_13 = Panel(ai_rlab_rpparser.status)
panel_14 = Panel(ai_rlab_programcommand.joint_values_deg)
panel_15 = Panel(ai_rlab_programjointcalibration.ll_command)
panel_16 = Panel(ai_rlab_programcommand.j7_mm)
panel_17 = Panel(ai_rlab_programjointcalibration.selected_joints)
panel_18 = Panel(ai_rlab_programjointcalibration.status)
panel_19 = Panel(ai_rlab_programcommand.rj_command)
panel_20 = Panel(ai_rlab_programcommand.status)
panel_21 = Panel("LLA0B0C0D0E0F0G1H0I0J0.000K0.000L0.000M0.000N0.000O0.000P0.000Q0.000R0.000")
ai_rlab_runrobotcalibration = Python3Script(Port="COM4", Baud="9600", Command=panel_21, Run=Toggle(True), Timeout=Slider(120, range=0..1000))  # -> sent, reply_lines, raw_reply, status
# ---------- ai_rlab_runrobotcalibration: Python ----------
#! python3
# r: pyserial

import time

try:
    import scriptcontext as sc
except Exception:
    sc = None


# ------------------------------------------------------------
# Helpers
# ------------------------------------------------------------

def unwrap_gh(value):
    if value is None:
        return None
    if hasattr(value, "Value"):
        return value.Value
    return value


def to_bool(value, default=False):
    value = unwrap_gh(value)

    if value is None:
        return default

    if isinstance(value, bool):
        return value

    return str(value).strip().lower() in ["true", "1", "yes", "y"]


def to_float(value, default=0.0):
    value = unwrap_gh(value)

    if value is None:
        return default

    try:
        return float(value)
    except Exception:
        try:
            return float(str(value).strip())
        except Exception:
            return default


# ------------------------------------------------------------
# Defaults
# ------------------------------------------------------------

sent = None
reply_lines = []
raw_reply = ""
status = ""


# ------------------------------------------------------------
# Main
# ------------------------------------------------------------

try:
    import serial

    port = str(unwrap_gh(Port) or "").strip()
    baud = int(to_float(Baud, 9600))
    command = str(unwrap_gh(Command) or "").strip()
    run = to_bool(Run, False)
    timeout = to_float(Timeout, 120.0)

    if not port:
        status = "No Port provided."

    elif not command:
        status = "No Command provided."

    else:
        edge_key = "AR4_CALIBRATION_LAST_RUN_STATE"
        previous_run = sc.sticky.get(edge_key, False) if sc else False

        if sc:
            sc.sticky[edge_key] = run

        if not run:
            status = "Ready. Set Run=True to send calibration command."

        elif previous_run:
            status = "Run is still True. Not sending again. Toggle Run False, then True to resend."

        else:
            ser = serial.Serial(
                port=port,
                baudrate=baud,
                timeout=0.1,
                write_timeout=2.0
            )

            time.sleep(2.0)

            try:
                ser.reset_input_buffer()
                ser.reset_output_buffer()
            except Exception:
                pass

            wire_command = command + "\n"
            ser.write(wire_command.encode("utf-8"))
            ser.flush()

            sent = wire_command.strip()

            start = time.time()
            buffer = ""

            while time.time() - start < timeout:
                if ser.in_waiting > 0:
                    data = ser.read(ser.in_waiting)
                    text = data.decode("utf-8", errors="ignore")
                    buffer += text

                    # Calibration should end by sending robot position.
                    # That response starts with A...B...C...
                    if "A" in buffer and "B" in buffer and "C" in buffer and "\n" in buffer:
                        break

                time.sleep(0.05)

            ser.close()

            raw_reply = buffer
            reply_lines = [line.strip() for line in buffer.splitlines() if line.strip()]

            if reply_lines:
                status = "Calibration command sent. Received {} reply line(s).".format(len(reply_lines))
            else:
                status = "Calibration command sent, but no reply received before timeout."

except Exception as e:
    sent = None
    reply_lines = []
    raw_reply = ""
    status = "ERROR: {}".format(e)
# ---------- end ai_rlab_runrobotcalibration ----------
panel_22 = Panel(ai_rlab_runrobotcalibration.sent)
panel_23 = Panel(ai_rlab_runrobotcalibration.reply_lines)
panel_24 = Panel(ai_rlab_runrobotcalibration.raw_reply)
panel_25 = Panel(ai_rlab_runrobotcalibration.status)
