# Grasshopper definition COMPAS_AR4_Base_v-12.gh (Grasshopper 1.0.8)
# plug-ins: Human

unit_z = UnitZ(Factor=1)
unit_y = UnitY(Factor=1)
point = Point(<point referenced from the Rhino model>)
circle_cnr = CircleCNR(Center=point, Normal=unit_z, Radius=Slider(100, range=1..100))
curve = Curve(<curve referenced from the Rhino model>)
xy_plane = XYPlane(Origin=Point(0, 0, 0))
flip_plane = FlipPlane(Plane=xy_plane, ReverseX=False, ReverseY=False, SwapAxes=True)
number_slider = Slider(10, range=0..10)
curve_2 = Curve([<curve referenced from the Rhino model> x8])
rotate = Rotate(Geometry=flip_plane, Angle=-3.141592654, Plane=PlaneXY(0, 0, 0))  # -> Geometry, Transform
divide_curve = DivideCurve(Curve=curve_2, Count=Slider(2, range=1..100), Kinks=False)  # -> Points, Tangents, Parameters
divide_distance = DivideDistance(Curve=curve_2, Distance=Slider(40, range=1..100))  # -> Points, Tangents, Parameters
deconstruct_plane = DeconstructPlane(Plane=rotate.Geometry)  # -> Origin, XAxis, YAxis, ZAxis
angle = Angle(VectorA=deconstruct_plane.YAxis, VectorB=divide_curve.Tangents, Plane=PlaneXY(0, 0, 0))  # -> Angle, Reflex
rotate_2 = Rotate(Geometry=flip_plane, Angle=angle.Angle, Plane=PlaneXY(0, 0, 0))  # -> Geometry, Transform
point_2 = Point([<point referenced from the Rhino model> x4])
pl_origin = PlaneOrigin(Base=rotate_2.Geometry, Origin=divide_curve.Points)
unit_z_2 = UnitZ(Factor=Slider(40, range=0..100))
list_item = ListItem(List=pl_origin, Index=0, Wrap=True)
list_item_2 = ListItem(List=pl_origin, Index=-1, Wrap=True)

# ----
# Example Commands
a_position_physical = Panel("RJA-30.000B71.000C15.000D0.000E0.000F00.000J70000.00J80.000J90.000Sm100.000Ac25.000Dc25.000Rm50.000WFLm000000")
way_position_physical = Panel("RJA00.000B0.000C15.000D0.000E0.000F00.000J70000.00J80.000J90.000Sm100.000Ac25.000Dc25.000Rm50.000WFLm000000")
b_position_physical = Panel("RJA30.000B71.000C15.000D0.000E0.000F00.000J70000.00J80.000J90.000Sm100.000Ac25.000Dc25.000Rm50.000WFLm000000")
merge = Merge(Data1=a_position_physical, Data2=way_position_physical, Data3=b_position_physical)  # -> flatten(Result)

# ----
# Visualize Robot Program
# in GH
move = Move(Geometry=list_item_2, Motion=unit_z_2)  # -> Geometry, Transform
move_2 = Move(Geometry=list_item, Motion=unit_z_2)  # -> Geometry, Transform
# Robot Startup
# (Port Connection)
# Path to URDF
# "ar4_compas_package_track.urdf"->
# Robot Calibration
# (Physical alibration of
# Joints with Limit Switches)
panel = Panel("Do this step")

# ----
# Rest & Home
home_position_simulated = Panel("RJA0.000B-0.000C0.000D0.000E45.000F00.000J7000.00J80.000J90.000Sm100.000Ac100.000Dc50.000Rm25.000WFLm000000")
# Send Commands to Robot
# for Physical Motion
rest_position_simulated = Panel("RJA0.000B0.000C-89.000D0.000E0.000F00.000J70000.00J80.000J90.000Sm100.000Ac100.000Dc50.000Rm25.000WFLm000000")

home_position_simulated_2 = Panel("RJA20.000B-0.000C0.000D0.000E45.000F00.000J7000.00J80.000J90.000Sm100.000Ac100.000Dc50.000Rm25.000WFLm000000")
insert_items = InsertItems(List=pl_origin, Item=move_2.Geometry, Indices=0, Wrap=True)
insert_items_2 = InsertItems(List=insert_items, Item=move.Geometry, Indices=-1, Wrap=True)  # -> flatten(List)
# Root Directory -->
plane = Plane(Plane(origin=(-0.710114148, 0.9110226668, 95.88598584), x=(-1, 0, 0), y=(0, -0.8822384213, 0.4708028971)))
point_3 = Point(<point referenced from the Rhino model>)
toggle = BooleanToggle(False)
value_list = ValueList({"tip1", "tip2", "tip3", "tip4", "axisX", "axisZ"}, selected="tip1")
list = ValueList({"TL", "LL", "RP"}, selected="LL")
list_2 = ValueList({"HO", "RP"}, selected="HO")
# Update Backslash to Forward Slash
pln = Plane(PlaneXY(0, 0, 0))
path = FilePath("C:\Users\pdanahy3\Documents\AR4_URDF\ar4_compas_package_track.urdf")
mesh = Mesh(<mesh referenced from the Rhino model>)
path_2 = FilePath("C:\Users\pdanahy3\Documents\AR4_URDF\")
ar4_run = Python3Script(
    Port="COM4",
    Baud="9600",
    Commands=rest_position_simulated,
    Run=Button(),
    Stop=Toggle(False),
    Delay="0.25",
    WaitForReply=Toggle(False),
    TimeoutPerCommand="3000",
    EncodeFirmwareOnSend=Toggle(True))  # -> sent_commands, reply_lines, parsed_states, completed, failed_index, status; inputs Commands: list
# ---------- ar4_run: Python ----------
#! python3
import scriptcontext as sc
exec(open(str(sc.sticky["PackageRoot"] ) + r"ar4_gh_direct_track_plugincomponents\05_run_serial_sender.py").read())
# ---------- end ar4_run ----------
ar4_startup = Python3Script(
    BasePlane=pln,
    Load=Toggle(True),
    Reload=Button(),
    URDF=path,
    PackageRoot=path_2,
    PreferredPort="COM4",
    ToolMeshes=mesh,
    ToolTCPPlane=plane,
    ToolTCPPoint=point_3,
    Baud="9600",
    TestCommand=list_2,
    Connect=Toggle(True))  # -> base_plane, cache_id, robot_model, robot_name, joint_names, link_names, mesh_link_names, mesh_count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; inputs ToolMeshes: list of Mesh
# ---------- ar4_startup: Python ----------
#! python3
import scriptcontext as sc
sc.sticky["PackageRoot"] = PackageRoot

exec(open(str(PackageRoot) + r"ar4_gh_direct_track_plugincomponents/01_startup_connection.py").read())
# ---------- end ar4_startup ----------
ar4_program = Python3Script(
    BasePlane=pln,
    cache_id=ar4_startup.cache_id,
    Targets=insert_items_2,
    Speed=Slider(100, range=0..100),
    Accel=Slider(100, range=0..100),
    Decel=Slider(25, range=0..100),
    Ramp=Slider(0, range=0..100),
    Wrist="F",
    UseTrack=Toggle(True),
    Solve=Toggle(True))  # -> solved, program_joint_values_rad, program_joint_values_deg, program_track_m, program_j7_mm, rj_commands, ik_errors, target_planes_robot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; inputs Targets: list of Plane
# ---------- ar4_program: Python ----------
#! python3
import scriptcontext as sc
exec(open(str(sc.sticky["PackageRoot"] ) + r"ar4_gh_direct_track_plugincomponents\03_program_ik_planner.py").read())
# ---------- end ar4_program ----------
commands = Merge(Data1=flatten(home_position_simulated), Data2=flatten(ar4_program.rj_commands), Data3=flatten(home_position_simulated))  # -> flatten(Result)
ar4_simulation = Python3Script(
    BasePlane=pln,
    Commands=commands,
    Time=Slider(0.38, range=0..1),
    ToolMeshes=mesh,
    HideGripper=Toggle(True),
    DrawRobot=Toggle(True),
    DrawTrack=Toggle(True),
    DrawPath=Toggle(True),
    DrawTargets=Toggle(True),
    DrawSkeleton=Toggle(True))  # -> active_command, robot_geometry, tool_geometry, track_geometry, skeleton_lines, simulation_state, status; inputs Commands: list, ToolMeshes: list of Mesh
# ---------- ar4_simulation: Python ----------
#! python3
import scriptcontext as sc
exec(open(str(sc.sticky["PackageRoot"] ) + r"ar4_gh_direct_track_plugincomponents\04_simulation_visualization.py").read())
# ---------- end ar4_simulation ----------
ar4_jog = Python3Script(
    J1=Slider(0, range=-180..180),
    J2=Slider(57, range=-180..180),
    J3=Slider(33, range=-180..180),
    J4=Slider(86, range=-180..180),
    J5=Slider(-8, range=-180..180),
    J6=Slider(0, range=-180..180),
    TrackM=Slider(0.5, range=0..1),
    Port="COM4",
    Baud="9600",
    Send=Button(),
    Capture=Button(),
    CaptureLabel=value_list,
    ClearCaptures=Button(),
    ToolMeshes=mesh)  # -> robot_geometry, tool_geometry, track_geometry, skeleton_lines, flange_plane, tcp_plane, rj_command, captures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; inputs ToolMeshes: Mesh
# ---------- ar4_jog: Python ----------
#! python3
import scriptcontext as sc
exec(open(str(sc.sticky["PackageRoot"] ) + r"ar4_gh_direct_track_plugincomponents\06_jog_control.py").read())
# ---------- end ar4_jog ----------
ar4_calibration = Python3Script(
    Port="COM4",
    Baud="9600",
    Mode=list,
    J1=Toggle(True),
    J2=Toggle(True),
    J3=Toggle(True),
    J4=Toggle(False),
    J5=Toggle(False),
    J6=Toggle(False),
    J7=Toggle(False),
    J8=Toggle(False),
    J9=Toggle(False),
    Run=Toggle(True),
    Timeout="120")  # -> sent_command, reply_lines, raw_reply, joint_values_deg, joint_values_rad, cartesian_pose, external_axes_mm, j7_mm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
# ---------- ar4_calibration: Python ----------
#! python3
import scriptcontext as sc
exec(open(str(sc.sticky["PackageRoot"] ) + r"ar4_gh_direct_track_plugincomponents\02_calibration.py").read())
# ---------- end ar4_calibration ----------
ar4_calibrate_tcp = Python3Script(Solve=Toggle(True), Apply=Button(), Clear=Button(), MaxAxisTiltDeg=Slider(90, range=0..180))  # -> tcp_frame, tcp_plane_local, tcp_offset_mm, fit_max_mm, fit_rms_mm, calibration_point, warnings, status
# ---------- ar4_calibrate_tcp: Python ----------
#! python3
import scriptcontext as sc
exec(open(str(sc.sticky["PackageRoot"] ) + r"ar4_gh_direct_track_plugincomponents\07_tcp_calibration.py").read())
# ---------- end ar4_calibrate_tcp ----------
point_4 = Point(ar4_jog.tcp_plane)
plane_2 = Plane(ar4_jog.tcp_plane)
mesh_2 = Mesh(ar4_jog.tool_geometry)
panel_2 = Panel(ar4_run.parsed_states)
preview = Preview(d1=[ar4_simulation.robot_geometry, ar4_simulation.tool_geometry], d2=ar4_simulation.track_geometry)  # -> R, C
panel_3 = Panel(ar4_run.completed)
panel_4 = Panel(ar4_run.status)
panel_5 = Panel(ar4_run.sent_commands)
panel_6 = Panel(ar4_program.status)
panel_7 = Panel(ar4_program.ik_errors)
panel_8 = Panel(ar4_program.solved)
panel_9 = Panel(ar4_startup.active_port)
panel_10 = Panel(ar4_startup.status)
panel_11 = Panel(ar4_startup.robot_name)
panel_12 = Panel(ar4_startup.startup_state)
panel_13 = Panel(ar4_calibration.calibration_state)
panel_14 = Panel(ar4_calibration.status)
panel_15 = Panel(ar4_calibration.sent_command)
bake_geometry = BakeGeometry(Bake=Toggle(False), Geometry=preview.R, DeleteOldBakes=False, PreserveTrees=False)
panel_16 = Panel(ar4_program.rj_commands)
crv = Curve(ar4_simulation.skeleton_lines)
panel_17 = Panel(ar4_calibration.joint_values_deg)
preview_2 = CustomPreview(Geometry=preview.R, Material=preview.C)
panel_18 = Panel(ar4_calibration.cartesian_pose)
panel_19 = Panel(ar4_calibration.joint_values_rad)
panel_20 = Panel(ar4_simulation.status)
panel_21 = Panel(ar4_simulation.active_command)
deplane = DeconstructPlane(Plane=ar4_program.target_planes_robot)  # -> Origin, XAxis, YAxis, ZAxis
panel_22 = Panel(ar4_calibration.j7_mm)
panel_23 = Panel(ar4_calibration.track_m)
panel_24 = Panel(ar4_calibration.external_axes_mm)

# ==== cluster Preview
d1 = ClusterInput()
d2 = ClusterInput()
merge = Merge(Data1=d1, Data2=d2)
lng = ListLength(List=merge)
index = ItemIndex(List=merge, Item=merge)
remap = RemapNumbers(Value=index, Source=lng, Target=Domain(0, 1))  # -> Mapped, Clipped
gradient = Gradient(LowerLimit=0, UpperLimit=1, Parameter=remap.Mapped, stops=[0: RGB(255, 255, 255), 1: RGB(0, 0, 0)])
R = ClusterOutput(merge)
C = ClusterOutput(gradient)
