# Grasshopper definition COMPAS_AR4_Base_v-4.gh (Grasshopper 1.0.8)

panel = Panel("RJA0.000B-0.000C0.000D0.000E0.000F0.000J7500.00J80.000J90.000Sm50.000Ac50.000Dc50.000Rm50.000WFLm000000")
panel_2 = Panel("RJA0.000B-0.000C0.000D0.000E0.000F0.000J70000.00J80.000J90.000Sm50.000Ac50.000Dc50.000Rm50.000WFLm000000")
crv = Curve(<curve referenced from the Rhino model>)
divide = DivideCurve(Curve=crv, Count=10, Kinks=False)  # -> Points, Tangents, Parameters
list = ValueList({"TL", "LL", "RP"}, selected="LL")
list_2 = ValueList({"HO", "RP"}, selected="HO")
path = FilePath("C:\Users\pdanahy3\Documents\AR4_URDF\ar4_compas_package_track.urdf")
path_2 = FilePath("C:\Users\pdanahy3\Documents\AR4_URDF\")
xy = XYPlane(Origin=divide.Points)
ar4_startup = Python3Script(
    Load=Toggle(True),
    Reload=Button(),
    URDF=path,
    PackageRoot=path_2,
    PreferredPort="COM4",
    Baud="9600",
    TestCommand=list_2,
    Connect=Toggle(True))  # -> cache_id, robot_model, robot_name, joint_names, link_names, mesh_link_names, mesh_count, available_ports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
# ---------- ar4_startup: Python ----------
#! python3
# r: pyserial
# r: compas
# r: compas_fab
# r: compas_robots

import os
import time
import math
import struct
import xml.etree.ElementTree as ET

import Rhino.Geometry as rg

try:
    import scriptcontext as sc
except Exception:
    sc = None


# ------------------------------------------------------------
# Helpers: Grasshopper values
# ------------------------------------------------------------

def unwrap_gh(value):
    if value is None:
        return None

    if hasattr(value, "Value"):
        return value.Value

    return value


def to_bool(value, default=False):
    value = unwrap_gh(value)

    if value is None:
        return default

    if isinstance(value, bool):
        return value

    return str(value).strip().lower() in ["true", "1", "yes", "y"]


def to_float(value, default=0.0):
    value = unwrap_gh(value)

    if value is None:
        return default

    try:
        return float(value)
    except Exception:
        try:
            return float(str(value).strip())
        except Exception:
            return default


def to_text(value, default=""):
    value = unwrap_gh(value)

    if value is None:
        return default

    return str(value).strip()


def safe_path(value):
    value = to_text(value, "")
    return value.strip().strip('"').strip("'")


def make_cache_id(urdf_path):
    base = os.path.basename(urdf_path)
    root, _ = os.path.splitext(base)

    try:
        stamp = int(os.path.getmtime(urdf_path))
    except Exception:
        stamp = 0

    clean = "".join([c if c.isalnum() else "_" for c in root])

    return "AR4_STARTUP_{}_{}".format(clean, stamp)


# ------------------------------------------------------------
# Helpers: URDF / mesh loading
# ------------------------------------------------------------

def parse_float_list(text, default_values):
    if text is None:
        return list(default_values)

    try:
        values = [float(v) for v in str(text).replace(",", " ").split()]
    except Exception:
        return list(default_values)

    result = list(default_values)

    for i in range(min(len(values), len(result))):
        result[i] = values[i]

    return result


def resolve_mesh_path(filename, urdf_path, package_root):
    if not filename:
        return None

    filename = filename.strip()

    # package://annin_ar4_description/meshes/...
    if filename.startswith("package://"):
        rel = filename.replace("package://", "", 1)
        parts = rel.replace("\\", "/").split("/")
        return os.path.join(package_root, *parts)

    # file:///C:/...
    if filename.startswith("file:///"):
        return filename.replace("file:///", "", 1)

    # file://C:/...
    if filename.startswith("file://"):
        return filename.replace("file://", "", 1)

    # absolute path
    if os.path.isabs(filename):
        return filename

    # relative to URDF folder
    return os.path.join(os.path.dirname(urdf_path), filename)


def add_triangle(mesh, v0, v1, v2):
    i0 = mesh.Vertices.Add(float(v0[0]), float(v0[1]), float(v0[2]))
    i1 = mesh.Vertices.Add(float(v1[0]), float(v1[1]), float(v1[2]))
    i2 = mesh.Vertices.Add(float(v2[0]), float(v2[1]), float(v2[2]))
    mesh.Faces.AddFace(i0, i1, i2)


def load_binary_stl(path):
    mesh = rg.Mesh()

    with open(path, "rb") as f:
        data = f.read()

    if len(data) < 84:
        return None

    tri_count = struct.unpack("<I", data[80:84])[0]
    expected = 84 + tri_count * 50

    if expected > len(data):
        return None

    offset = 84

    for _ in range(tri_count):
        # normal = data[offset:offset+12]
        offset += 12

        v0 = struct.unpack("<fff", data[offset:offset + 12])
        offset += 12

        v1 = struct.unpack("<fff", data[offset:offset + 12])
        offset += 12

        v2 = struct.unpack("<fff", data[offset:offset + 12])
        offset += 12

        # attribute byte count
        offset += 2

        add_triangle(mesh, v0, v1, v2)

    mesh.Normals.ComputeNormals()
    mesh.Compact()

    return mesh


def load_ascii_stl(path):
    mesh = rg.Mesh()
    tri = []

    with open(path, "r", errors="ignore") as f:
        for line in f:
            s = line.strip()

            if s.lower().startswith("vertex"):
                parts = s.split()

                if len(parts) >= 4:
                    v = (float(parts[1]), float(parts[2]), float(parts[3]))
                    tri.append(v)

                    if len(tri) == 3:
                        add_triangle(mesh, tri[0], tri[1], tri[2])
                        tri = []

    if mesh.Faces.Count == 0:
        return None

    mesh.Normals.ComputeNormals()
    mesh.Compact()

    return mesh


def load_stl(path):
    # Try binary first.
    try:
        mesh = load_binary_stl(path)

        if mesh is not None and mesh.Faces.Count > 0:
            return mesh
    except Exception:
        pass

    # Then ASCII.
    try:
        mesh = load_ascii_stl(path)

        if mesh is not None and mesh.Faces.Count > 0:
            return mesh
    except Exception:
        pass

    return None


def load_obj(path):
    verts = []
    mesh = rg.Mesh()

    with open(path, "r", errors="ignore") as f:
        for line in f:
            s = line.strip()

            if not s or s.startswith("#"):
                continue

            if s.startswith("v "):
                parts = s.split()

                if len(parts) >= 4:
                    verts.append((
                        float(parts[1]),
                        float(parts[2]),
                        float(parts[3])
                    ))

            elif s.startswith("f "):
                parts = s.split()[1:]
                indices = []

                for part in parts:
                    token = part.split("/")[0]

                    if not token:
                        continue

                    idx = int(token)

                    if idx < 0:
                        idx = len(verts) + idx
                    else:
                        idx = idx - 1

                    indices.append(idx)

                if len(indices) >= 3:
                    # triangulate fan
                    for i in range(1, len(indices) - 1):
                        v0 = verts[indices[0]]
                        v1 = verts[indices[i]]
                        v2 = verts[indices[i + 1]]
                        add_triangle(mesh, v0, v1, v2)

    if mesh.Faces.Count == 0:
        return None

    mesh.Normals.ComputeNormals()
    mesh.Compact()

    return mesh


def load_mesh_file(path):
    ext = os.path.splitext(path)[1].lower()

    if ext == ".stl":
        return load_stl(path)

    if ext == ".obj":
        return load_obj(path)

    # DAE and other formats are not loaded here.
    return None


def transform_mesh_from_urdf_visual(mesh, xyz, rpy, scale):
    moved = mesh.DuplicateMesh()

    sx, sy, sz = scale
    tx, ty, tz = xyz
    roll, pitch, yaw = rpy

    # Apply mesh scale manually.
    for i in range(moved.Vertices.Count):
        p = moved.Vertices[i]
        p.X *= sx
        p.Y *= sy
        p.Z *= sz
        moved.Vertices.SetVertex(i, p)

    origin = rg.Point3d(0, 0, 0)

    # URDF rpy convention: roll X, pitch Y, yaw Z.
    moved.Transform(rg.Transform.Rotation(roll, rg.Vector3d.XAxis, origin))
    moved.Transform(rg.Transform.Rotation(pitch, rg.Vector3d.YAxis, origin))
    moved.Transform(rg.Transform.Rotation(yaw, rg.Vector3d.ZAxis, origin))
    moved.Transform(rg.Transform.Translation(tx, ty, tz))

    moved.Normals.ComputeNormals()
    moved.Compact()

    return moved


def parse_mesh_cache_from_urdf(urdf_path, package_root):
    mesh_cache = {}
    mesh_load_report = []

    if not os.path.exists(urdf_path):
        return mesh_cache, ["URDF file does not exist: {}".format(urdf_path)]

    try:
        tree = ET.parse(urdf_path)
        root = tree.getroot()
    except Exception as e:
        return mesh_cache, ["Could not parse URDF XML: {}".format(e)]

    for link in root.findall("link"):
        link_name = link.attrib.get("name", "")

        if not link_name:
            continue

        for visual in link.findall("visual"):
            origin = visual.find("origin")

            if origin is not None:
                xyz = parse_float_list(origin.attrib.get("xyz", None), [0.0, 0.0, 0.0])
                rpy = parse_float_list(origin.attrib.get("rpy", None), [0.0, 0.0, 0.0])
            else:
                xyz = [0.0, 0.0, 0.0]
                rpy = [0.0, 0.0, 0.0]

            geometry = visual.find("geometry")

            if geometry is None:
                continue

            mesh_node = geometry.find("mesh")

            if mesh_node is None:
                # Primitive boxes/cylinders are handled by the visualization component.
                continue

            filename = mesh_node.attrib.get("filename", "")
            scale = parse_float_list(mesh_node.attrib.get("scale", None), [1.0, 1.0, 1.0])

            mesh_path = resolve_mesh_path(filename, urdf_path, package_root)

            if not mesh_path or not os.path.exists(mesh_path):
                mesh_load_report.append(
                    "Missing mesh for link {}: {}".format(link_name, mesh_path)
                )
                continue

            mesh = load_mesh_file(mesh_path)

            if mesh is None:
                mesh_load_report.append(
                    "Could not load mesh format for link {}: {}".format(link_name, mesh_path)
                )
                continue

            mesh = transform_mesh_from_urdf_visual(mesh, xyz, rpy, scale)

            if link_name not in mesh_cache:
                mesh_cache[link_name] = []

            mesh_cache[link_name].append(mesh)

    return mesh_cache, mesh_load_report


def infer_package_name_from_urdf(urdf_path):
    try:
        text = open(urdf_path, "r", errors="ignore").read()
    except Exception:
        return "annin_ar4_description"

    marker = "package://"

    idx = text.find(marker)

    if idx < 0:
        return "annin_ar4_description"

    start = idx + len(marker)
    rest = text[start:]
    parts = rest.replace("\\", "/").split("/")

    if parts:
        return parts[0]

    return "annin_ar4_description"


# ------------------------------------------------------------
# Helpers: COM port / serial handshake
# ------------------------------------------------------------

def scan_ports():
    ports = []
    names = []

    try:
        import serial.tools.list_ports

        for p in serial.tools.list_ports.comports():
            label = "{} | {} | {}".format(p.device, p.description, p.hwid)
            ports.append(label)

            if p.device not in names:
                names.append(p.device)

    except Exception as e:
        ports.append("pyserial scan error: {}".format(e))

    # Fallback through .NET SerialPort if available.
    try:
        from System.IO.Ports import SerialPort

        for name in SerialPort.GetPortNames():
            label = "{} | .NET SerialPort".format(name)
            ports.append(label)

            if name not in names:
                names.append(name)

    except Exception:
        pass

    return ports, names


def choose_port(preferred_port, available_port_labels, available_port_names):
    preferred_port = preferred_port.strip()

    if preferred_port and preferred_port in available_port_names:
        return preferred_port

    # Prefer Teensy USB VID/PID used by the AR4 controller.
    for label in available_port_labels:
        if "VID:PID=16C0:0483" in label:
            return label.split("|")[0].strip()

    # Prefer USB serial devices.
    for label in available_port_labels:
        lower = label.lower()

        if "usb" in lower or "teensy" in lower:
            return label.split("|")[0].strip()

    if available_port_names:
        return available_port_names[0]

    return ""


def serial_handshake(port, baud, command, timeout):
    import serial

    reply_lines = []
    raw_reply = ""

    ser = serial.Serial(
        port=port,
        baudrate=baud,
        timeout=0.1,
        write_timeout=2.0
    )

    # Teensy serial connection settle time.
    time.sleep(2.0)

    try:
        ser.reset_input_buffer()
        ser.reset_output_buffer()
    except Exception:
        pass

    wire_command = command.strip() + "\n"

    ser.write(wire_command.encode("utf-8"))
    ser.flush()

    start = time.time()
    buffer = ""

    while time.time() - start < timeout:
        if ser.in_waiting > 0:
            data = ser.read(ser.in_waiting)
            text = data.decode("utf-8", errors="ignore")
            buffer += text

            if "\n" in buffer:
                break

        time.sleep(0.02)

    ser.close()

    raw_reply = buffer
    reply_lines = [line.strip() for line in buffer.splitlines() if line.strip()]

    return reply_lines, raw_reply


# ------------------------------------------------------------
# Defaults / outputs
# ------------------------------------------------------------

cache_id = None
robot_model = None
robot_name = None
joint_names = []
motion_joint_names = []
link_names = []
mesh_link_names = []
mesh_count = 0
available_ports = []
active_port = ""
handshake_reply = []
startup_state = {}
status = ""


# ------------------------------------------------------------
# Main
# ------------------------------------------------------------

try:
    if sc is None:
        raise Exception("scriptcontext is not available.")

    load = to_bool(Load, True)
    reload = to_bool(Reload, False)

    urdf_path = safe_path(URDF)
    package_root = safe_path(PackageRoot)

    preferred_port = to_text(PreferredPort, "COM4")
    baud = int(to_float(Baud, 9600))
    test_command = to_text(TestCommand, "HO")

    connect = to_bool(Connect, False)

    if not urdf_path:
        raise Exception("No URDF path provided.")

    if not package_root:
        raise Exception("No PackageRoot path provided.")

    cache_id = make_cache_id(urdf_path)

    # ------------------------------------------------------------
    # 1. Scan serial ports
    # ------------------------------------------------------------

    available_ports, available_port_names = scan_ports()
    active_port = choose_port(preferred_port, available_ports, available_port_names)

    # ------------------------------------------------------------
    # 2. Load / cache robot model and meshes
    # ------------------------------------------------------------

    model_key = cache_id + "::model"
    mesh_key = cache_id + "::meshes"
    state_key = cache_id + "::startup_state"
    report_key = cache_id + "::mesh_load_report"

    cached_model = sc.sticky.get(model_key, None)

    if load and (reload or cached_model is None):

        if not os.path.exists(urdf_path):
            raise Exception("URDF file does not exist: {}".format(urdf_path))

        from compas_robots import RobotModel

        model = RobotModel.from_urdf_file(urdf_path)

        # Try to load COMPAS geometry as well, but do not depend on it.
        try:
            from compas_robots.resources import LocalPackageMeshLoader

            package_name = infer_package_name_from_urdf(urdf_path)
            loader = LocalPackageMeshLoader(package_root, package_name)
            model.load_geometry(loader)

        except Exception:
            pass

        mesh_cache, mesh_report = parse_mesh_cache_from_urdf(urdf_path, package_root)

        sc.sticky[model_key] = model
        sc.sticky[mesh_key] = mesh_cache
        sc.sticky[report_key] = mesh_report

    elif cached_model is not None:
        model = cached_model
        mesh_cache = sc.sticky.get(mesh_key, {})
        mesh_report = sc.sticky.get(report_key, [])

    else:
        model = None
        mesh_cache = {}
        mesh_report = []

    if model is not None:
        robot_model = model
        robot_name = model.name

        try:
            joint_names = model.get_configurable_joint_names()
        except Exception:
            joint_names = []

        try:
            link_names = [link.name for link in model.links]
        except Exception:
            link_names = []

    else:
        robot_model = None
        robot_name = None
        joint_names = []
        link_names = []

    # Motion joints used by the AR4 + track.
    # Gripper joint, if present, is intentionally excluded.
    motion_joint_names = [
        "track_joint",
        "joint_1",
        "joint_2",
        "joint_3",
        "joint_4",
        "joint_5",
        "joint_6"
    ]

    mesh_link_names = sorted(list(mesh_cache.keys()))
    mesh_count = 0

    for meshes in mesh_cache.values():
        try:
            mesh_count += len(meshes)
        except Exception:
            pass

    # ------------------------------------------------------------
    # 3. Optional serial handshake
    # ------------------------------------------------------------

    if connect:

        if not active_port:
            handshake_reply = []
            handshake_raw = ""
            serial_status = "No active COM port found."

        else:
            try:
                handshake_reply, handshake_raw = serial_handshake(
                    active_port,
                    baud,
                    test_command,
                    3.0
                )

                if handshake_reply:
                    serial_status = "Connected. {} returned {} line(s).".format(
                        test_command,
                        len(handshake_reply)
                    )
                else:
                    serial_status = "Sent {}, but no reply received.".format(test_command)

            except Exception as e:
                handshake_reply = []
                handshake_raw = ""
                serial_status = "Serial connection error: {}".format(e)

    else:
        handshake_reply = []
        handshake_raw = ""
        serial_status = "Connect is False. Port scan only."

    # ------------------------------------------------------------
    # 4. Store startup state
    # ------------------------------------------------------------

    startup_state = {
        "cache_id": cache_id,
        "urdf": urdf_path,
        "package_root": package_root,
        "port": active_port,
        "baud": baud,
        "test_command": test_command,
        "track_length_mm": 1000.0,
        "track_firmware_inverted": False,
        "track_home_is_motor_side": True,
        "firmware_j7_home_mm": 0.0,
        "logical_track_m_motor_side": 0.0,
        "logical_track_m_far_side": 1.0,
        "firmware_j7_formula": "J7_mm = TrackM * 1000.0",
        "use_calibration_frame_default": False,
        "home_urdf_deg_default": [0.0, 0.0, 0.0, 0.0, 0.0, 0.0],
        "target_units_mm": True,
        "motion_joint_names": motion_joint_names,
        "mesh_load_report": mesh_report
    }

    sc.sticky[state_key] = startup_state

    # ------------------------------------------------------------
    # 5. Status
    # ------------------------------------------------------------

    report_text = ""

    if mesh_report:
        report_text = " Mesh warnings: {}.".format(len(mesh_report))

    if model is not None:
        model_status = "Loaded robot '{}' with {} configurable joint(s), {} link(s), and {} cached mesh object(s).".format(
            robot_name,
            len(joint_names),
            len(link_names),
            mesh_count
        )
    else:
        model_status = "Robot model not loaded. Set Load=True."

    status = "{} Active port: {}. {}{}".format(
        model_status,
        active_port if active_port else "None",
        serial_status,
        report_text
    )

except Exception as e:
    cache_id = None
    robot_model = None
    robot_name = None
    joint_names = []
    motion_joint_names = []
    link_names = []
    mesh_link_names = []
    mesh_count = 0
    available_ports = []
    active_port = ""
    handshake_reply = []
    startup_state = {}
    status = "ERROR: {}".format(e)
# ---------- end ar4_startup ----------
ar4_calibration = Python3Script(
    Port="COM4",
    Baud="9600",
    Mode=list,
    J1=Toggle(False),
    J2=Toggle(False),
    J3=Toggle(False),
    J4=Toggle(False),
    J5=Toggle(False),
    J6=Toggle(False),
    J7=Toggle(True),
    J8=Toggle(False),
    J9=Toggle(False),
    Run=Toggle(True),
    Timeout="120")  # -> sent_command, reply_lines, raw_reply, joint_values_deg, joint_values_rad, cartesian_pose, external_axes_mm, j7_mm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
# ---------- ar4_calibration: Python ----------
#! python3
# r: pyserial

import time
import math

try:
    import scriptcontext as sc
except Exception:
    sc = None


# ------------------------------------------------------------
# Helpers: Grasshopper values
# ------------------------------------------------------------

def unwrap_gh(value):
    if value is None:
        return None

    if hasattr(value, "Value"):
        return value.Value

    return value


def to_bool(value, default=False):
    value = unwrap_gh(value)

    if value is None:
        return default

    if isinstance(value, bool):
        return value

    return str(value).strip().lower() in ["true", "1", "yes", "y"]


def to_float(value, default=0.0):
    value = unwrap_gh(value)

    if value is None:
        return default

    try:
        return float(value)
    except Exception:
        try:
            return float(str(value).strip())
        except Exception:
            return default


def to_int_flag(value):
    return 1 if to_bool(value, False) else 0


def to_text(value, default=""):
    value = unwrap_gh(value)

    if value is None:
        return default

    return str(value).strip()


def clamp(value, low, high):
    if value < low:
        return low

    if value > high:
        return high

    return value


# ------------------------------------------------------------
# Helpers: command construction
# ------------------------------------------------------------

def normalize_mode(value):
    mode = to_text(value, "RP").strip().upper()

    if mode in ["TEST", "TEST_LIMITS", "LIMIT", "LIMITS"]:
        return "TL"

    if mode in ["CAL", "CALIBRATE", "CALIBRATION", "HOME", "HOMING"]:
        return "LL"

    if mode in ["READ", "POSITION", "READ_POSITION"]:
        return "RP"

    if mode not in ["TL", "LL", "RP"]:
        return "RP"

    return mode


def build_ll_command(flags):
    """
    Firmware LL format:

    LL
    A-I = selected joint flags J1-J9
    J-R = calibration offsets J1-J9

    This simplified component uses zero offsets.
    """

    j1, j2, j3, j4, j5, j6, j7, j8, j9 = flags

    return (
        "LL"
        "A{j1}"
        "B{j2}"
        "C{j3}"
        "D{j4}"
        "E{j5}"
        "F{j6}"
        "G{j7}"
        "H{j8}"
        "I{j9}"
        "J0.000"
        "K0.000"
        "L0.000"
        "M0.000"
        "N0.000"
        "O0.000"
        "P0.000"
        "Q0.000"
        "R0.000"
    ).format(
        j1=j1,
        j2=j2,
        j3=j3,
        j4=j4,
        j5=j5,
        j6=j6,
        j7=j7,
        j8=j8,
        j9=j9
    )


def selected_joint_names(flags):
    names = []

    for i, flag in enumerate(flags):
        if flag == 1:
            names.append("J{}".format(i + 1))

    return names


# ------------------------------------------------------------
# Helpers: RP parsing
# ------------------------------------------------------------

def clean_rp_reply(value):
    if value is None:
        return ""

    s = str(value).strip()

    for line in s.splitlines():
        line = line.strip()

        # RP position strings begin with A and include external axis P.
        if line.startswith("A") and "B" in line and "C" in line and "P" in line:
            return line

    return ""


def between(s, start_token, end_token=None):
    start = s.find(start_token)

    if start < 0:
        return ""

    start += len(start_token)

    if end_token is None:
        return s[start:].strip()

    end = s.find(end_token, start)

    if end < 0:
        return s[start:].strip()

    return s[start:end].strip()


def parse_rp(rp):
    result = {
        "joint_values_deg": [],
        "joint_values_rad": [],
        "cartesian_pose": [],
        "external_axes_mm": [],
        "j7_mm": 0.0,
        "track_m": 0.0,
        "speed_violation": "",
        "debug": "",
        "flag": "",
        "parsed": False
    }

    if not rp:
        return result

    try:
        # A-F = robot joint angles in degrees.
        A = to_float(between(rp, "A", "B"))
        B = to_float(between(rp, "B", "C"))
        C = to_float(between(rp, "C", "D"))
        D = to_float(between(rp, "D", "E"))
        E = to_float(between(rp, "E", "F"))
        F = to_float(between(rp, "F", "G"))

        joint_values_deg = [A, B, C, D, E, F]
        joint_values_rad = [math.radians(v) for v in joint_values_deg]

        # G-L = firmware Cartesian pose.
        X = to_float(between(rp, "G", "H"))
        Y = to_float(between(rp, "H", "I"))
        Z = to_float(between(rp, "I", "J"))

        Rz = to_float(between(rp, "J", "K"))
        Ry = to_float(between(rp, "K", "L"))
        Rx = to_float(between(rp, "L", "M"))

        cartesian_pose = [X, Y, Z, Rz, Ry, Rx]

        # M-O = diagnostics.
        speed_violation = between(rp, "M", "N")
        debug = between(rp, "N", "O")
        flag = between(rp, "O", "P")

        # P-R = external axes.
        P = to_float(between(rp, "P", "Q"))
        Q = to_float(between(rp, "Q", "R"))
        R = to_float(between(rp, "R", None))

        external_axes_mm = [P, Q, R]

        # J7 track mapping (shared convention):
        #
        # Firmware:
        #   J7 = 0 mm   -> motor / home-switch side
        #   J7 = 1000 mm -> far end
        #
        # URDF / COMPAS TrackM:
        #   TrackM = J7_mm / 1000.0
        j7_mm_value = P
        track_m_value = clamp(j7_mm_value / 1000.0, 0.0, 1.0)

        result["joint_values_deg"] = joint_values_deg
        result["joint_values_rad"] = joint_values_rad
        result["cartesian_pose"] = cartesian_pose
        result["external_axes_mm"] = external_axes_mm
        result["j7_mm"] = j7_mm_value
        result["track_m"] = track_m_value
        result["speed_violation"] = speed_violation
        result["debug"] = debug
        result["flag"] = flag
        result["parsed"] = True

        return result

    except Exception:
        return result


# ------------------------------------------------------------
# Helpers: TL parsing
# ------------------------------------------------------------

def clean_tl_reply(value):
    if value is None:
        return ""

    s = str(value).strip()

    for line in s.splitlines():
        line = line.strip()

        # Original firmware returns "J1 = 0   J2 = 0..."
        # Updated firmware may return "J1=0 J2=0 ..."
        if "J1" in line and "J2" in line:
            return line

    return ""


def parse_tl(tl):
    result = {
        "raw": tl,
        "switches": {},
        "parsed": False
    }

    if not tl:
        return result

    normalized = (
        tl.replace("=", " ")
          .replace(",", " ")
          .replace(":", " ")
          .replace("\t", " ")
    )

    parts = normalized.split()

    switches = {}

    for i, part in enumerate(parts):
        p = part.strip().upper()

        if p.startswith("J") and len(p) >= 2:
            try:
                joint_number = int(p[1:])
            except Exception:
                continue

            if i + 1 < len(parts):
                value = parts[i + 1].strip()

                if value in ["0", "1"]:
                    switches["J{}".format(joint_number)] = int(value)

    if switches:
        result["switches"] = switches
        result["parsed"] = True

    return result


# ------------------------------------------------------------
# Helpers: serial
# ------------------------------------------------------------

def send_serial_command(port, baud, command, timeout):
    import serial

    ser = serial.Serial(
        port=port,
        baudrate=baud,
        timeout=0.1,
        write_timeout=2.0
    )

    # Teensy serial settle.
    time.sleep(2.0)

    try:
        ser.reset_input_buffer()
        ser.reset_output_buffer()
    except Exception:
        pass

    wire_command = command.strip() + "\n"

    ser.write(wire_command.encode("utf-8"))
    ser.flush()

    start = time.time()
    buffer = ""

    while time.time() - start < timeout:
        if ser.in_waiting > 0:
            data = ser.read(ser.in_waiting)
            text = data.decode("utf-8", errors="ignore")
            buffer += text

            # TL and RP should return one line.
            if command.startswith("TL") or command.startswith("RP"):
                if "\n" in buffer:
                    break

            # LL can take longer and should eventually return an RP-style line.
            if command.startswith("LL"):
                if clean_rp_reply(buffer):
                    break

        time.sleep(0.05)

    ser.close()

    lines = [line.strip() for line in buffer.splitlines() if line.strip()]

    return wire_command.strip(), lines, buffer


# ------------------------------------------------------------
# Outputs / defaults
# ------------------------------------------------------------

sent_command = None
reply_lines = []
raw_reply = ""

joint_values_deg = []
joint_values_rad = []
cartesian_pose = []
external_axes_mm = []
j7_mm = 0.0
track_m = 0.0

calibration_state = {}
status = ""


# ------------------------------------------------------------
# Main
# ------------------------------------------------------------

try:
    if sc is None:
        raise Exception("scriptcontext is not available.")

    port = to_text(Port, "").strip()
    baud = int(to_float(Baud, 9600))
    mode = normalize_mode(Mode)
    run = to_bool(Run, False)
    timeout = to_float(Timeout, 120.0)

    flags = [
        to_int_flag(J1),
        to_int_flag(J2),
        to_int_flag(J3),
        to_int_flag(J4),
        to_int_flag(J5),
        to_int_flag(J6),
        to_int_flag(J7),
        to_int_flag(J8),
        to_int_flag(J9)
    ]

    selected = selected_joint_names(flags)

    if not port:
        status = "No Port provided."

    elif baud <= 0:
        status = "Invalid Baud value."

    else:
        # Build command based on mode.
        if mode == "TL":
            command = "TL"

        elif mode == "RP":
            command = "RP"

        elif mode == "LL":
            command = build_ll_command(flags)

        else:
            command = "RP"

        # Edge-trigger Run so Grasshopper does not repeatedly calibrate.
        edge_key = "AR4_CALIBRATION_COMPONENT_LAST_RUN_STATE"
        previous_run = sc.sticky.get(edge_key, False)

        sc.sticky[edge_key] = run

        if not run:
            sent_command = command

            if mode == "LL":
                if selected:
                    status = "Ready. Mode=LL. Selected joints: {}. Toggle Run True to calibrate.".format(
                        ", ".join(selected)
                    )
                else:
                    status = "Ready. Mode=LL, but no joints are selected."

            else:
                status = "Ready. Mode={}. Toggle Run True to send {}.".format(mode, command)

        elif previous_run:
            sent_command = command
            status = "Run is still True. Not sending again. Toggle Run False, then True to resend."

        else:
            if mode == "LL" and not selected:
                sent_command = command
                status = "Mode=LL but no joints selected. Nothing sent."

            else:
                sent_command, reply_lines, raw_reply = send_serial_command(
                    port,
                    baud,
                    command,
                    timeout
                )

                rp_line = clean_rp_reply(raw_reply)
                tl_line = clean_tl_reply(raw_reply)

                rp_result = parse_rp(rp_line)
                tl_result = parse_tl(tl_line)

                joint_values_deg = rp_result["joint_values_deg"]
                joint_values_rad = rp_result["joint_values_rad"]
                cartesian_pose = rp_result["cartesian_pose"]
                external_axes_mm = rp_result["external_axes_mm"]
                j7_mm = rp_result["j7_mm"]
                track_m = rp_result["track_m"]

                calibration_state = {
                    "mode": mode,
                    "selected_joints": selected,
                    "sent_command": sent_command,
                    "reply_lines": reply_lines,
                    "rp_line": rp_line,
                    "rp_parsed": rp_result["parsed"],
                    "tl_line": tl_line,
                    "tl_parsed": tl_result["parsed"],
                    "limit_switches": tl_result["switches"],
                    # Firmware RP joints == Annin DH / URDF joints (no home offset).
                    "joint_values_deg": joint_values_deg,
                    "joint_values_rad": joint_values_rad,
                    "firmware_joint_values_deg": joint_values_deg,
                    "urdf_joint_values_deg": joint_values_deg,
                    "urdf_joint_values_rad": joint_values_rad,
                    "cartesian_pose": cartesian_pose,
                    "external_axes_mm": external_axes_mm,
                    "j7_mm": j7_mm,
                    "track_m": track_m,
                    "track_firmware_inverted": False,
                    "track_length_mm": 1000.0,
                    "port": port,
                    "baud": baud
                }

                # Store last useful calibration/read state for later components.
                sc.sticky["AR4_LAST_CALIBRATION_STATE"] = calibration_state

                if mode == "TL":
                    if tl_result["parsed"]:
                        status = "TL complete. Limit switches: {}".format(tl_result["switches"])
                    elif reply_lines:
                        status = "TL sent. Reply received but could not parse switch states: {}".format(reply_lines)
                    else:
                        status = "TL sent, but no reply received."

                elif mode == "RP":
                    if rp_result["parsed"]:
                        status = "RP complete. J7 {:.3f} mm → TrackM {:.4f}. Joints parsed.".format(
                            j7_mm,
                            track_m
                        )
                    elif reply_lines:
                        status = "RP sent. Reply received but could not parse RP line: {}".format(reply_lines)
                    else:
                        status = "RP sent, but no reply received."

                elif mode == "LL":
                    if rp_result["parsed"]:
                        status = "LL calibration complete for {}. J7 {:.3f} mm → TrackM {:.4f}.".format(
                            ", ".join(selected),
                            j7_mm,
                            track_m
                        )
                    elif reply_lines:
                        status = "LL sent for {}. Reply received but no RP line parsed: {}".format(
                            ", ".join(selected),
                            reply_lines
                        )
                    else:
                        status = "LL sent for {}, but no reply received before timeout.".format(
                            ", ".join(selected)
                        )

except Exception as e:
    sent_command = None
    reply_lines = []
    raw_reply = ""

    joint_values_deg = []
    joint_values_rad = []
    cartesian_pose = []
    external_axes_mm = []
    j7_mm = 0.0
    track_m = 0.0

    calibration_state = {}
    status = "ERROR: {}".format(e)
# ---------- end ar4_calibration ----------
ar4_run = Python3Script(
    Port="COM4",
    Baud="9600",
    Commands=panel_2,
    Run=Toggle(False),
    Stop=Toggle(False),
    Delay="0.25",
    WaitForReply=Toggle(False),
    TimeoutPerCommand="30")  # -> sent_commands, reply_lines, parsed_states, completed, failed_index, status; inputs Commands: list
# ---------- ar4_run: Python ----------
#! python3
# r: pyserial

import time
import math

try:
    import scriptcontext as sc
except Exception:
    sc = None


# ------------------------------------------------------------
# Helpers: Grasshopper values
# ------------------------------------------------------------

def unwrap_gh(value):
    if value is None:
        return None

    if hasattr(value, "Value"):
        return value.Value

    return value


def to_bool(value, default=False):
    value = unwrap_gh(value)

    if value is None:
        return default

    if isinstance(value, bool):
        return value

    return str(value).strip().lower() in ["true", "1", "yes", "y"]


def to_float(value, default=0.0):
    value = unwrap_gh(value)

    if value is None:
        return default

    try:
        return float(value)
    except Exception:
        try:
            return float(str(value).strip())
        except Exception:
            return default


def to_text(value, default=""):
    value = unwrap_gh(value)

    if value is None:
        return default

    return str(value).strip()


def clamp(value, low, high):
    if value < low:
        return low

    if value > high:
        return high

    return value


def to_command_list(values):
    """
    Accepts:
      - a GH list of command strings
      - one multiline panel
      - a single command string

    Returns a clean list of RJ commands.
    """
    if values is None:
        return []

    values = unwrap_gh(values)

    try:
        raw = list(values)
    except TypeError:
        raw = [values]

    result = []

    for item in raw:
        item = unwrap_gh(item)

        if item is None:
            continue

        s = str(item).strip()

        if not s:
            continue

        # Allow one text panel with multiple commands.
        if "\n" in s:
            for line in s.splitlines():
                line = line.strip()

                if line:
                    result.append(line)
        else:
            result.append(s)

    cleaned = []

    for cmd in result:
        cmd = cmd.strip()

        if not cmd:
            continue

        if cmd.upper().startswith("RJ"):
            cleaned.append(cmd)

    return cleaned


# ------------------------------------------------------------
# RJ command validation
# ------------------------------------------------------------

def validate_rj_command(command):
    """
    Checks only the command structure.
    Does not decide whether the motion is physically safe.
    """
    if command is None:
        return False, "Command is None."

    s = str(command).strip()

    if not s.upper().startswith("RJ"):
        return False, "Command does not start with RJ."

    required_tokens = [
        "A",
        "B",
        "C",
        "D",
        "E",
        "F",
        "J7",
        "J8",
        "J9",
        "Sm",
        "Ac",
        "Dc",
        "Rm",
        "W",
        "Lm"
    ]

    for token in required_tokens:
        if token not in s:
            return False, "Missing token {}.".format(token)

    # This catches the earlier malformed external-axis form:
    # J70.500J00.000J00.000
    if "J0" in s:
        if "J00." in s or "J00" in s:
            return False, "Command appears to contain J0. Use J8 and J9 for external axes."

    return True, "OK"


# ------------------------------------------------------------
# RP parsing
# ------------------------------------------------------------

def between(s, start_token, end_token=None):
    start = s.find(start_token)

    if start < 0:
        return ""

    start += len(start_token)

    if end_token is None:
        return s[start:].strip()

    end = s.find(end_token, start)

    if end < 0:
        return s[start:].strip()

    return s[start:end].strip()


def clean_rp_reply(value):
    if value is None:
        return ""

    s = str(value).strip()

    for line in s.splitlines():
        line = line.strip()

        if line.startswith("A") and "B" in line and "C" in line and "P" in line:
            return line

    return ""


def parse_rp_line(rp):
    """
    Parses firmware RP-style position line.

    Firmware reports:
      A-F = J1-J6 degrees
      G-L = Cartesian pose
      M-O = diagnostics
      P-R = J7-J9 external axes

    J7 mapping (shared convention):
      firmware J7 = 0 mm     -> TrackM = 0.0 (motor / home)
      firmware J7 = 500 mm   -> TrackM = 0.5
      firmware J7 = 1000 mm  -> TrackM = 1.0 (far end)
      TrackM = J7_mm / 1000.0
    """
    result = {
        "parsed": False,
        "joint_values_deg": [],
        "joint_values_rad": [],
        "cartesian_pose": [],
        "external_axes_mm": [],
        "j7_mm": 0.0,
        "track_m": 0.0,
        "speed_violation": "",
        "debug": "",
        "flag": "",
        "raw": rp
    }

    if not rp:
        return result

    try:
        A = to_float(between(rp, "A", "B"))
        B = to_float(between(rp, "B", "C"))
        C = to_float(between(rp, "C", "D"))
        D = to_float(between(rp, "D", "E"))
        E = to_float(between(rp, "E", "F"))
        F = to_float(between(rp, "F", "G"))

        joint_values_deg = [A, B, C, D, E, F]
        joint_values_rad = [math.radians(v) for v in joint_values_deg]

        X = to_float(between(rp, "G", "H"))
        Y = to_float(between(rp, "H", "I"))
        Z = to_float(between(rp, "I", "J"))

        Rz = to_float(between(rp, "J", "K"))
        Ry = to_float(between(rp, "K", "L"))
        Rx = to_float(between(rp, "L", "M"))

        speed_violation = between(rp, "M", "N")
        debug = between(rp, "N", "O")
        flag = between(rp, "O", "P")

        P = to_float(between(rp, "P", "Q"))
        Q = to_float(between(rp, "Q", "R"))
        R = to_float(between(rp, "R", None))

        j7_mm = P

        track_m = (j7_mm / 1000.0)
        track_m = clamp(track_m, 0.0, 1.0)

        result["parsed"] = True
        result["joint_values_deg"] = joint_values_deg
        result["joint_values_rad"] = joint_values_rad
        result["cartesian_pose"] = [X, Y, Z, Rz, Ry, Rx]
        result["external_axes_mm"] = [P, Q, R]
        result["j7_mm"] = j7_mm
        result["track_m"] = track_m
        result["speed_violation"] = speed_violation
        result["debug"] = debug
        result["flag"] = flag

        return result

    except Exception:
        return result


# ------------------------------------------------------------
# Serial helpers
# ------------------------------------------------------------

def read_reply_for_command(ser, timeout, wait_for_rp=True):
    """
    Reads serial response after one command.

    For RJ, the firmware should eventually return a position line.
    This function also stops early if it sees ER/EL-style errors.
    """
    buffer = ""
    start = time.time()

    while time.time() - start < timeout:
        if ser.in_waiting > 0:
            data = ser.read(ser.in_waiting)
            text = data.decode("utf-8", errors="ignore")
            buffer += text

            lines = [line.strip() for line in buffer.splitlines() if line.strip()]

            for line in lines:
                # Firmware error strings.
                if line == "ER":
                    return lines, buffer, "ERROR_ER"

                if line.startswith("EL"):
                    return lines, buffer, "ERROR_EL"

                # RP-style position line.
                if line.startswith("A") and "B" in line and "C" in line and "P" in line:
                    return lines, buffer, "RP"

            # If we are not specifically waiting for an RP line, return after first line.
            if not wait_for_rp and "\n" in buffer:
                return lines, buffer, "LINE"

        time.sleep(0.02)

    lines = [line.strip() for line in buffer.splitlines() if line.strip()]

    if buffer:
        return lines, buffer, "TIMEOUT_WITH_DATA"

    return lines, buffer, "TIMEOUT_EMPTY"


def send_command_sequence(port, baud, commands, delay, wait_for_reply, timeout_per_command):
    import serial

    sent = []
    replies = []
    raw = []
    parsed = []

    failed = -1
    failure_reason = ""

    ser = serial.Serial(
        port=port,
        baudrate=baud,
        timeout=0.1,
        write_timeout=2.0
    )

    # Give Teensy serial connection time to settle.
    time.sleep(2.0)

    try:
        ser.reset_input_buffer()
        ser.reset_output_buffer()
    except Exception:
        pass

    for i, command in enumerate(commands):
        ok, message = validate_rj_command(command)

        if not ok:
            failed = i
            failure_reason = "Invalid command at index {}: {}".format(i, message)
            break

        wire_command = command.strip() + "\n"

        try:
            ser.write(wire_command.encode("utf-8"))
            ser.flush()

        except Exception as e:
            failed = i
            failure_reason = "Serial write failed at index {}: {}".format(i, e)
            break

        sent.append(command.strip())

        if wait_for_reply:
            lines, buffer, reply_status = read_reply_for_command(
                ser,
                timeout_per_command,
                wait_for_rp=True
            )

            replies.append(lines)
            raw.append(buffer)

            rp_line = clean_rp_reply(buffer)
            state = parse_rp_line(rp_line)

            state["command_index"] = i
            state["reply_status"] = reply_status
            parsed.append(state)

            if reply_status in ["ERROR_ER", "ERROR_EL"]:
                failed = i
                failure_reason = "Firmware returned {} at command index {}.".format(
                    reply_status,
                    i
                )
                break

            if reply_status in ["TIMEOUT_EMPTY", "TIMEOUT_WITH_DATA"]:
                failed = i
                failure_reason = "Timed out waiting for reply at command index {}.".format(i)
                break

        else:
            replies.append([])
            raw.append("")
            parsed.append({
                "parsed": False,
                "command_index": i,
                "reply_status": "NOT_WAITING"
            })

        if delay > 0.0:
            time.sleep(delay)

    try:
        ser.close()
    except Exception:
        pass

    return sent, replies, raw, parsed, failed, failure_reason


# ------------------------------------------------------------
# Outputs / defaults
# ------------------------------------------------------------

sent_commands = []
reply_lines = []
raw_replies = []
parsed_states = []
last_reply = ""
last_rp_state = {}
run_index = -1
completed = False
failed_index = -1
status = ""


# ------------------------------------------------------------
# Main
# ------------------------------------------------------------

try:
    if sc is None:
        raise Exception("scriptcontext is not available.")

    port = to_text(Port, "").strip()
    baud = int(to_float(Baud, 9600))

    commands = to_command_list(Commands)

    run = to_bool(Run, False)
    stop = to_bool(Stop, False)

    delay = to_float(Delay, 0.25)
    wait_for_reply = to_bool(WaitForReply, True)
    timeout_per_command = to_float(TimeoutPerCommand, 30.0)

    if delay < 0.0:
        delay = 0.0

    if timeout_per_command < 1.0:
        timeout_per_command = 1.0

    # Store latest visible command list for debugging.
    sc.sticky["AR4_LAST_RUN_INPUT_COMMANDS"] = commands

    if stop:
        sc.sticky["AR4_RUN_LAST_STATE"] = {
            "sent_commands": [],
            "reply_lines": [],
            "raw_replies": [],
            "parsed_states": [],
            "completed": False,
            "failed_index": -1,
            "status": "Stopped before run."
        }

        status = "Stop=True. Nothing sent."

    elif not port:
        status = "No Port provided."

    elif baud <= 0:
        status = "Invalid Baud."

    elif not commands:
        status = "No RJ commands provided. Connect Program rj_commands to Commands."

    else:
        # Validate all commands before opening serial.
        validation_errors = []

        for i, cmd in enumerate(commands):
            ok, msg = validate_rj_command(cmd)

            if not ok:
                validation_errors.append("Index {}: {}".format(i, msg))

        if validation_errors:
            status = "Command validation failed. {}".format("; ".join(validation_errors[:3]))

        else:
            # Edge-trigger Run.
            edge_key = "AR4_RUN_COMPONENT_LAST_RUN_STATE"
            previous_run = sc.sticky.get(edge_key, False)

            sc.sticky[edge_key] = run

            last_state = sc.sticky.get("AR4_RUN_LAST_STATE", None)

            if not run:
                if isinstance(last_state, dict):
                    sent_commands = last_state.get("sent_commands", [])
                    reply_lines = last_state.get("reply_lines", [])
                    raw_replies = last_state.get("raw_replies", [])
                    parsed_states = last_state.get("parsed_states", [])
                    completed = last_state.get("completed", False)
                    failed_index = last_state.get("failed_index", -1)

                    if raw_replies:
                        last_reply = raw_replies[-1]

                    if parsed_states:
                        last_rp_state = parsed_states[-1]
                        run_index = last_rp_state.get("command_index", -1)

                    status = "Run=False. Holding last run state. {} command(s) previously sent.".format(
                        len(sent_commands)
                    )
                else:
                    status = "Ready. {} command(s) loaded. Toggle Run True to send.".format(
                        len(commands)
                    )

            elif previous_run:
                if isinstance(last_state, dict):
                    sent_commands = last_state.get("sent_commands", [])
                    reply_lines = last_state.get("reply_lines", [])
                    raw_replies = last_state.get("raw_replies", [])
                    parsed_states = last_state.get("parsed_states", [])
                    completed = last_state.get("completed", False)
                    failed_index = last_state.get("failed_index", -1)

                    if raw_replies:
                        last_reply = raw_replies[-1]

                    if parsed_states:
                        last_rp_state = parsed_states[-1]
                        run_index = last_rp_state.get("command_index", -1)

                    status = "Run is still True. Not resending. Toggle Run False, then True to run again."
                else:
                    status = "Run is True, but no previous run state exists. Toggle Run False, then True."

            else:
                sent_commands, reply_lines, raw_replies, parsed_states, failed_index, failure_reason = send_command_sequence(
                    port=port,
                    baud=baud,
                    commands=commands,
                    delay=delay,
                    wait_for_reply=wait_for_reply,
                    timeout_per_command=timeout_per_command
                )

                if raw_replies:
                    last_reply = raw_replies[-1]

                if parsed_states:
                    last_rp_state = parsed_states[-1]
                    run_index = last_rp_state.get("command_index", -1)

                completed = failed_index < 0 and len(sent_commands) == len(commands)

                run_state = {
                    "sent_commands": sent_commands,
                    "reply_lines": reply_lines,
                    "raw_replies": raw_replies,
                    "parsed_states": parsed_states,
                    "last_reply": last_reply,
                    "last_rp_state": last_rp_state,
                    "run_index": run_index,
                    "completed": completed,
                    "failed_index": failed_index,
                    "port": port,
                    "baud": baud
                }

                sc.sticky["AR4_RUN_LAST_STATE"] = run_state

                if completed:
                    status = "Run complete. Sent {} of {} command(s).".format(
                        len(sent_commands),
                        len(commands)
                    )
                else:
                    status = "Run stopped/failure. Sent {} of {} command(s). Failed index: {}. {}".format(
                        len(sent_commands),
                        len(commands),
                        failed_index,
                        failure_reason
                    )

except Exception as e:
    sent_commands = []
    reply_lines = []
    raw_replies = []
    parsed_states = []
    last_reply = ""
    last_rp_state = {}
    run_index = -1
    completed = False
    failed_index = -1
    status = "ERROR: {}".format(e)
# ---------- end ar4_run ----------
ar4_program = Python3Script(
    cache_id=ar4_startup.cache_id,
    Targets=xy,
    ToolZ="60",
    Speed=Slider(50, range=0..100),
    Accel=Slider(50, range=0..100),
    Decel=Slider(50, range=0..100),
    Ramp=Slider(50, range=0..100),
    Wrist="F",
    UseTrack=Toggle(True),
    Solve=Toggle(True))  # -> solved, program_joint_values_rad, program_joint_values_deg, program_track_m, program_j7_mm, rj_commands, ik_errors, target_planes_robot, program_state, status; inputs Targets: list of Plane
# ---------- ar4_program: Python ----------
#! python3
# r: compas
# r: compas_fab
# r: compas_robots

"""
AR4 + External Track — Component 3: Program / IK Planner
Calibration-frame aware replacement.

PRIMARY PURPOSE
---------------
IK solves in the URDF / COMPAS geometric joint frame.
Annin firmware RJ degrees are the same DH joint degrees after LL calibration
(see ar4-hmi kinematics.cpp). By default there is NO home-frame offset.

Optional MotDir / axis-sign correction remains available via JointSigns.
Optional HomeJointsDeg offset is OFF by default (UseCalibrationFrame=False).

Rhino / Grasshopper world units for this project are millimeters.
URDF / COMPAS are meters. Targets and ToolZ are converted mm -> m.

Track convention (shared across Comp2/3/4/5):
    TrackM = 0.0  -> firmware J7 = 0 mm   (motor / home-switch side)
    TrackM = 1.0  -> firmware J7 = 1000 mm (far end)
    J7_mm = TrackM * TrackLengthMM

INPUTS — original required inputs
---------------------------------
cache_id            : from Startup component
Targets             : TCP target planes, points, or plane-like values (mm origins)
ToolZ               : TCP offset along tool-link local Z, in millimeters
Speed               : arm move speed value, normally firmware Sm value
Accel               : firmware Ac percent
Decel               : firmware Dc percent
Ramp                : firmware Rm value
Wrist               : firmware W token, usually "F"
UseTrack            : bool, solve with track_joint enabled
Solve               : bool edge trigger; toggle False -> True to recompute

OPTIONAL INPUTS — add these to the GH Python component when needed
-----------------------------------------------------------------
UseCalibrationFrame : bool, default False. Keep False unless FK gold tests prove
                      URDF zero differs from Annin DH / firmware zero.
HomeJointsDeg       : list/string of 6 URDF degrees at firmware A0..F0.
                      Only used when UseCalibrationFrame=True.
JointSigns          : list/string of 6 signs, default 1,1,1,1,1,1.
                      Use -1 where MotDir / URDF axis sense opposes firmware +.
SplitTrackMotion    : bool, default False. Keep False for synchronized arm+J7
                      moves so TCP interpolates through targets smoothly.
                      Set True only if you need a J7-only preposition before the
                      arm move (legacy; breaks continuous TCP motion).
TrackSpeedPercent   : default 100.0. Used only when SplitTrackMotion=True.
MaxSolveSeconds     : default 300.0. Hard abort for difficult paths.
TrackMoveEpsilonMM  : default 0.5. Minimum J7 change before split preposition.
TrackFirmwareInverted : bool, default False.
                        False: J7_mm = TrackM * 1000
                        True:  J7_mm = (1-TrackM) * 1000
TrackLengthMM       : default 1000.0.
TargetUnitsMM       : bool, default True. Scale Rhino target origins and ToolZ
                      from mm to meters.

OUTPUTS — original outputs
--------------------------
solved
program_joint_values_rad       : URDF / true joint radians per target
program_joint_values_deg       : URDF / true joint degrees per target
program_track_m                : URDF TrackM per target
program_j7_mm                  : firmware J7 mm per target
rj_commands                    : expanded firmware command list
ik_errors
target_planes_robot
tcp_planes_solved
program_state
status
"""

import math
import os
import time
import xml.etree.ElementTree as ET

import Rhino.Geometry as rg

try:
    import scriptcontext as sc
except Exception:
    sc = None


# ------------------------------------------------------------
# Helpers: Grasshopper values
# ------------------------------------------------------------

def unwrap_gh(value):
    if value is None:
        return None
    if hasattr(value, "Value"):
        return value.Value
    return value


def get_optional_input(name, default=None):
    return globals().get(name, default)


def to_bool(value, default=False):
    value = unwrap_gh(value)
    if value is None:
        return default
    if isinstance(value, bool):
        return value
    text = str(value).strip().lower()
    if text in ["true", "1", "yes", "y", "on"]:
        return True
    if text in ["false", "0", "no", "n", "off"]:
        return False
    return default


def to_float(value, default=0.0):
    value = unwrap_gh(value)
    if value is None:
        return default
    try:
        return float(value)
    except Exception:
        try:
            return float(str(value).strip())
        except Exception:
            return default


def to_text(value, default=""):
    value = unwrap_gh(value)
    if value is None:
        return default
    return str(value).strip()


def clamp(value, low, high):
    if value < low:
        return low
    if value > high:
        return high
    return value


def parse_float_list_input(value, count=None, default=None):
    """
    Accepts GH lists, tuples, panels like "1,2,3", or semicolon/space text.
    Returns list[float] or default.
    """
    value = unwrap_gh(value)
    if value is None:
        return default

    raw = []

    if isinstance(value, str):
        text = value.replace(";", ",").replace(" ", ",")
        parts = [p for p in text.split(",") if p.strip()]
        raw = parts
    else:
        try:
            raw = list(value)
        except TypeError:
            raw = [value]

    vals = []
    for item in raw:
        try:
            vals.append(float(unwrap_gh(item)))
        except Exception:
            try:
                vals.append(float(str(item).strip()))
            except Exception:
                pass

    if count is not None:
        if len(vals) < count:
            return default
        vals = vals[:count]

    if not vals:
        return default

    return vals


def flatten_targets(values):
    """
    Accepts:
      - a single Rhino Plane
      - a GH list of Rhino Planes
      - Rhino Points, converted to WorldXY-aligned planes
      - simple wrappers with a .Plane property

    Returns:
      list[rg.Plane]
    """
    if values is None:
        return []

    values = unwrap_gh(values)

    if isinstance(values, rg.Plane):
        return [values]

    try:
        raw = list(values)
    except TypeError:
        raw = [values]

    result = []

    for item in raw:
        item = unwrap_gh(item)

        if isinstance(item, rg.Plane):
            result.append(item)

        elif isinstance(item, rg.Point3d):
            result.append(
                rg.Plane(
                    item,
                    rg.Vector3d.XAxis,
                    rg.Vector3d.YAxis
                )
            )

        elif hasattr(item, "Plane") and isinstance(item.Plane, rg.Plane):
            result.append(item.Plane)

    return result


# ------------------------------------------------------------
# Constants
# ------------------------------------------------------------

MOTION_JOINT_NAMES = [
    "track_joint",
    "joint_1",
    "joint_2",
    "joint_3",
    "joint_4",
    "joint_5",
    "joint_6"
]

# Annin firmware joint degrees == DH joint degrees after LL.
# Do not invent a J5=45 home offset unless FK gold tests prove otherwise.
DEFAULT_HOME_URDF_DEG = [0.0, 0.0, 0.0, 0.0, 0.0, 0.0]
DEFAULT_JOINT_SIGNS = [1.0, 1.0, 1.0, 1.0, 1.0, 1.0]


# ------------------------------------------------------------
# Deadline / timeout
# ------------------------------------------------------------

def check_deadline(deadline_time):
    if deadline_time is None:
        return
    if time.time() > deadline_time:
        raise Exception("Program solve exceeded MaxSolveSeconds and was aborted.")


# ------------------------------------------------------------
# URDF parsing and caching
# ------------------------------------------------------------

def parse_float_list(text, default_values):
    if text is None:
        return list(default_values)

    try:
        values = [float(v) for v in str(text).replace(",", " ").split()]
    except Exception:
        return list(default_values)

    result = list(default_values)

    for i in range(min(len(values), len(result))):
        result[i] = values[i]

    return result


def get_urdf_path_from_cache(cache_id):
    """
    Startup component stores:
      <cache_id>::startup_state

    This retrieves the URDF path from that startup state.
    """
    if sc is None:
        return ""

    state = sc.sticky.get(cache_id + "::startup_state", None)

    if isinstance(state, dict):
        return state.get("urdf", "")

    return ""


def parse_urdf_motion_joints_uncached(urdf_path):
    """
    Reads the actual motion joint data from the URDF:
      - joint type
      - parent link
      - child link
      - origin xyz/rpy
      - axis
      - limits

    This is used to build the geometric Jacobian from the real skeleton.
    """
    data = {}

    if not urdf_path or not os.path.exists(urdf_path):
        return data

    root = ET.parse(urdf_path).getroot()

    for joint in root.findall("joint"):
        name = joint.attrib.get("name", "")

        if name not in MOTION_JOINT_NAMES:
            continue

        jtype = joint.attrib.get("type", "")

        parent = joint.find("parent")
        child = joint.find("child")
        origin = joint.find("origin")
        axis = joint.find("axis")
        limit = joint.find("limit")

        parent_link = parent.attrib.get("link", "") if parent is not None else ""
        child_link = child.attrib.get("link", "") if child is not None else ""

        xyz = [0.0, 0.0, 0.0]
        rpy = [0.0, 0.0, 0.0]

        if origin is not None:
            xyz = parse_float_list(
                origin.attrib.get("xyz", None),
                [0.0, 0.0, 0.0]
            )

            rpy = parse_float_list(
                origin.attrib.get("rpy", None),
                [0.0, 0.0, 0.0]
            )

        axis_xyz = [0.0, 0.0, 0.0]

        if axis is not None:
            axis_xyz = parse_float_list(
                axis.attrib.get("xyz", None),
                [0.0, 0.0, 0.0]
            )

        lower = -math.pi
        upper = math.pi

        if name == "track_joint":
            lower = 0.0
            upper = 1.0

        if limit is not None:
            try:
                lower = float(limit.attrib.get("lower", lower))
            except Exception:
                pass

            try:
                upper = float(limit.attrib.get("upper", upper))
            except Exception:
                pass

        data[name] = {
            "name": name,
            "type": jtype,
            "parent": parent_link,
            "child": child_link,
            "xyz": xyz,
            "rpy": rpy,
            "axis": axis_xyz,
            "lower": lower,
            "upper": upper
        }

    return data


def get_joint_info(cache_id, urdf_path):
    """
    Cached URDF joint info. Cache key includes the URDF path so swapping URDFs
    does not accidentally keep stale track_joint data.
    """
    if sc is None:
        return {}

    key = cache_id + "::motion_joint_info::" + str(urdf_path)

    cached = sc.sticky.get(key, None)

    if isinstance(cached, dict) and cached:
        return cached

    joint_info = parse_urdf_motion_joints_uncached(urdf_path)
    sc.sticky[key] = joint_info

    return joint_info


# ------------------------------------------------------------
# COMPAS / Rhino FK helpers
# ------------------------------------------------------------

def compas_frame_to_plane(frame):
    p = frame.point
    x = frame.xaxis
    y = frame.yaxis

    return rg.Plane(
        rg.Point3d(float(p.x), float(p.y), float(p.z)),
        rg.Vector3d(float(x.x), float(x.y), float(x.z)),
        rg.Vector3d(float(y.x), float(y.y), float(y.z))
    )


def safe_fk(model, config, link_name=None):
    try:
        if link_name:
            return model.forward_kinematics(config, link_name=link_name)
        return model.forward_kinematics(config)
    except TypeError:
        try:
            if link_name:
                return model.forward_kinematics(config, link_name)
            return model.forward_kinematics(config)
        except Exception:
            return None
    except Exception:
        return None


def choose_tool_link(model):
    """
    Choose the end-effector link for the TCP frame.
    Adjust this list if your URDF has a specific final tool link.
    """
    try:
        link_names = [link.name for link in model.links]
    except Exception:
        link_names = []

    preferred = [
        "ee_link",
        "tool0",
        "tool_link",
        "pneumatic_gripper_tool_link",
        "link_6"
    ]

    for name in preferred:
        if name in link_names:
            return name

    if link_names:
        return link_names[-1]

    return None


def make_config(model, track_m, joints_rad):
    """
    Builds a COMPAS robot configuration from URDF TrackM and J1-J6 radians.

    IMPORTANT:
    This function always receives true URDF / geometric joint values.
    It does not receive firmware-home-relative RJ command values.
    """
    config = model.zero_configuration()

    try:
        configurable = model.get_configurable_joint_names()
    except Exception:
        configurable = []

    if "track_joint" in configurable:
        config["track_joint"] = clamp(track_m, 0.0, 1.0)

    for i in range(6):
        name = "joint_{}".format(i + 1)

        if name in configurable:
            config[name] = joints_rad[i]

    if "gripper_jaw1_joint" in configurable:
        config["gripper_jaw1_joint"] = 0.0

    return config


def offset_plane_along_z(plane, distance):
    """
    ToolZ is the TCP offset from the chosen tool/flange link along local Z.

    If the TCP offset goes the wrong direction, use a negative ToolZ.
    """
    p = rg.Plane(plane)
    z = rg.Vector3d(p.ZAxis)

    if z.Length > 1e-12:
        z.Unitize()

    p.Origin = p.Origin + z * distance

    return p


def current_tcp_plane(model, config, tool_link, tool_z):
    frame = safe_fk(model, config, tool_link)

    if frame is None:
        return None

    flange_plane = compas_frame_to_plane(frame)
    tcp_plane = offset_plane_along_z(flange_plane, tool_z)

    return tcp_plane


def parent_frames_for_chain(model, config, joint_info, active_joint_names):
    """
    Computes only the parent link frames needed by the active IK chain.
    This is much faster than collecting every link frame.
    """
    frames = {}
    parent_links = []

    for name in active_joint_names:
        info = joint_info.get(name, None)

        if not info:
            continue

        parent = info.get("parent", "")

        if parent and parent not in parent_links:
            parent_links.append(parent)

    for link_name in parent_links:
        frame = safe_fk(model, config, link_name)

        if frame is not None:
            frames[link_name] = compas_frame_to_plane(frame)

    return frames


def plane_origin_transform(parent_plane, xyz, rpy):
    """
    Converts a URDF joint origin into a world/model-space Rhino Plane.

    URDF joint origin:
      xyz is translated in the parent link frame
      rpy rotates the joint frame relative to the parent link frame
    """
    origin = (
        parent_plane.Origin
        + rg.Vector3d(parent_plane.XAxis) * xyz[0]
        + rg.Vector3d(parent_plane.YAxis) * xyz[1]
        + rg.Vector3d(parent_plane.ZAxis) * xyz[2]
    )

    joint_plane = rg.Plane(parent_plane)
    joint_plane.Origin = origin

    roll, pitch, yaw = rpy

    joint_plane.Transform(
        rg.Transform.Rotation(
            roll,
            joint_plane.XAxis,
            joint_plane.Origin
        )
    )

    joint_plane.Transform(
        rg.Transform.Rotation(
            pitch,
            joint_plane.YAxis,
            joint_plane.Origin
        )
    )

    joint_plane.Transform(
        rg.Transform.Rotation(
            yaw,
            joint_plane.ZAxis,
            joint_plane.Origin
        )
    )

    return joint_plane


def axis_world_from_joint_plane(joint_plane, axis_xyz):
    """
    Converts the URDF joint axis from the local joint frame into world/model space.
    """
    v = (
        rg.Vector3d(joint_plane.XAxis) * axis_xyz[0]
        + rg.Vector3d(joint_plane.YAxis) * axis_xyz[1]
        + rg.Vector3d(joint_plane.ZAxis) * axis_xyz[2]
    )

    if v.Length > 1e-12:
        v.Unitize()

    return v


# ------------------------------------------------------------
# Target scaling
# ------------------------------------------------------------

def guess_target_scale(targets, force_mm=True):
    """
    The URDF is in meters. Rhino targets in this project are millimeters.

    force_mm=True (default): always convert origins mm -> m.
    force_mm=False: heuristic fallback if |xyz| > 5 treat as mm.
    """
    if force_mm:
        return 0.001

    max_abs = 0.0

    for pl in targets:
        p = pl.Origin
        max_abs = max(max_abs, abs(p.X), abs(p.Y), abs(p.Z))

    if max_abs > 5.0:
        return 0.001

    return 1.0


def scale_plane_origin(plane, scale):
    p = rg.Plane(plane)

    if abs(scale - 1.0) < 1e-12:
        return p

    p.Origin = rg.Point3d(
        p.Origin.X * scale,
        p.Origin.Y * scale,
        p.Origin.Z * scale
    )

    return p


# ------------------------------------------------------------
# Error and Jacobian
# ------------------------------------------------------------

def plane_error(current_plane, target_plane, rotation_weight):
    """
    6D error:
      target position - current position
      plus small-angle orientation error from current axes to target axes
    """
    dp = target_plane.Origin - current_plane.Origin

    cx = rg.Vector3d(current_plane.XAxis)
    cy = rg.Vector3d(current_plane.YAxis)
    cz = rg.Vector3d(current_plane.ZAxis)

    tx = rg.Vector3d(target_plane.XAxis)
    ty = rg.Vector3d(target_plane.YAxis)
    tz = rg.Vector3d(target_plane.ZAxis)

    cx.Unitize()
    cy.Unitize()
    cz.Unitize()

    tx.Unitize()
    ty.Unitize()
    tz.Unitize()

    ex = rg.Vector3d.CrossProduct(cx, tx)
    ey = rg.Vector3d.CrossProduct(cy, ty)
    ez = rg.Vector3d.CrossProduct(cz, tz)

    er = rg.Vector3d(
        0.5 * (ex.X + ey.X + ez.X),
        0.5 * (ex.Y + ey.Y + ez.Y),
        0.5 * (ex.Z + ey.Z + ez.Z)
    )

    return [
        float(dp.X),
        float(dp.Y),
        float(dp.Z),
        float(er.X) * rotation_weight,
        float(er.Y) * rotation_weight,
        float(er.Z) * rotation_weight
    ]


def error_norm(err):
    return math.sqrt(sum(v * v for v in err))


def build_geometric_jacobian(model, config, joint_info, active_joint_names, tcp_point):
    """
    Builds a 6 x n geometric Jacobian from the real URDF skeleton.

    Revolute joint:
      linear  = axis_world x (tcp - joint_origin)
      angular = axis_world

    Prismatic joint:
      linear  = axis_world
      angular = zero
    """
    parent_frames = parent_frames_for_chain(
        model,
        config,
        joint_info,
        active_joint_names
    )

    J = [[0.0 for _ in range(len(active_joint_names))] for _ in range(6)]

    for col, name in enumerate(active_joint_names):
        info = joint_info.get(name, None)

        if info is None:
            continue

        parent_link = info["parent"]

        if parent_link not in parent_frames:
            continue

        parent_plane = parent_frames[parent_link]

        joint_plane = plane_origin_transform(
            parent_plane,
            info["xyz"],
            info["rpy"]
        )

        axis_world = axis_world_from_joint_plane(
            joint_plane,
            info["axis"]
        )

        joint_origin = joint_plane.Origin

        if info["type"] == "prismatic":
            linear = rg.Vector3d(axis_world)
            angular = rg.Vector3d(0, 0, 0)
        else:
            r = tcp_point - joint_origin
            linear = rg.Vector3d.CrossProduct(axis_world, r)
            angular = rg.Vector3d(axis_world)

        J[0][col] = float(linear.X)
        J[1][col] = float(linear.Y)
        J[2][col] = float(linear.Z)

        J[3][col] = float(angular.X)
        J[4][col] = float(angular.Y)
        J[5][col] = float(angular.Z)

    return J


# ------------------------------------------------------------
# Linear algebra
# ------------------------------------------------------------

def mat_transpose(A):
    return [[A[r][c] for r in range(len(A))] for c in range(len(A[0]))]


def mat_mul(A, B):
    rows = len(A)
    cols = len(B[0])
    inner = len(B)

    out = []

    for r in range(rows):
        row = []

        for c in range(cols):
            s = 0.0

            for k in range(inner):
                s += A[r][k] * B[k][c]

            row.append(s)

        out.append(row)

    return out


def mat_vec_mul(A, x):
    return [sum(a * b for a, b in zip(row, x)) for row in A]


def solve_linear_system(A, b):
    """
    Gaussian elimination with partial pivoting.
    """
    n = len(A)
    M = [list(row) for row in A]
    y = list(b)

    for k in range(n):
        pivot = k
        pivot_abs = abs(M[k][k])

        for r in range(k + 1, n):
            if abs(M[r][k]) > pivot_abs:
                pivot_abs = abs(M[r][k])
                pivot = r

        if pivot_abs < 1e-12:
            return [0.0 for _ in range(n)]

        if pivot != k:
            M[k], M[pivot] = M[pivot], M[k]
            y[k], y[pivot] = y[pivot], y[k]

        for r in range(k + 1, n):
            factor = M[r][k] / M[k][k]

            for c in range(k, n):
                M[r][c] -= factor * M[k][c]

            y[r] -= factor * y[k]

    x = [0.0 for _ in range(n)]

    for i in reversed(range(n)):
        s = y[i]

        for j in range(i + 1, n):
            s -= M[i][j] * x[j]

        if abs(M[i][i]) < 1e-12:
            x[i] = 0.0
        else:
            x[i] = s / M[i][i]

    return x


def damped_least_squares(J, err, damping):
    """
    dq = inverse(JT J + lambda^2 I) JT err
    """
    JT = mat_transpose(J)
    JTJ = mat_mul(JT, J)
    JTe = mat_vec_mul(JT, err)

    n = len(JTJ)

    for i in range(n):
        JTJ[i][i] += damping * damping

    return solve_linear_system(JTJ, JTe)


# ------------------------------------------------------------
# Bounds and active variables
# ------------------------------------------------------------

def active_joint_names(use_track):
    if use_track:
        return list(MOTION_JOINT_NAMES)

    return MOTION_JOINT_NAMES[1:]


def get_bounds(joint_info, names):
    lower = []
    upper = []

    for name in names:
        info = joint_info.get(name, None)

        if info is None:
            if name == "track_joint":
                lower.append(0.0)
                upper.append(1.0)
            else:
                lower.append(-math.pi)
                upper.append(math.pi)

        else:
            lower.append(info["lower"])
            upper.append(info["upper"])

    return lower, upper


def bound_q(q, lower, upper):
    return [clamp(v, lo, hi) for v, lo, hi in zip(q, lower, upper)]


def unpack_q(q, fixed_track_m, use_track):
    if use_track:
        track_m = q[0]
        joints = list(q[1:7])
    else:
        track_m = fixed_track_m
        joints = list(q[:6])

    track_m = clamp(track_m, 0.0, 1.0)

    while len(joints) < 6:
        joints.append(0.0)

    return track_m, joints[:6]


def angle_wrap_pi(a):
    while a > math.pi:
        a -= 2.0 * math.pi

    while a < -math.pi:
        a += 2.0 * math.pi

    return a


# ------------------------------------------------------------
# Track-aware IK helpers
# ------------------------------------------------------------

def make_reposture_seeds(seed_track_m, seed_joints_rad, use_track):
    """
    Generate alternate seeds when the track reaches a limit.

    The target plane stays the same, but we retry with:
      - track pulled slightly away from its limit
      - alternate J1/J2/J3 postures
    """
    seeds = []

    base_joints = list(seed_joints_rad[:6])

    while len(base_joints) < 6:
        base_joints.append(0.0)

    seed_track_m = clamp(seed_track_m, 0.0, 1.0)

    if use_track:
        if seed_track_m < 0.12:
            track_candidates = [
                seed_track_m,
                0.05,
                0.12,
                0.20,
                0.35,
                0.50
            ]

        elif seed_track_m > 0.88:
            track_candidates = [
                seed_track_m,
                0.95,
                0.88,
                0.80,
                0.65,
                0.50
            ]

        else:
            track_candidates = [
                seed_track_m,
                clamp(seed_track_m - 0.15, 0.0, 1.0),
                clamp(seed_track_m + 0.15, 0.0, 1.0),
                0.50
            ]

    else:
        track_candidates = [seed_track_m]

    deg_offsets = [
        (0,    0,    0),

        (10,   0,    0),
        (-10,  0,    0),
        (20,   0,    0),
        (-20,  0,    0),
        (35,   0,    0),
        (-35,  0,    0),

        (0,    10,   0),
        (0,   -10,   0),
        (0,    20,   0),
        (0,   -20,   0),

        (0,    0,    10),
        (0,    0,   -10),
        (0,    0,    20),
        (0,    0,   -20),

        (20,   10,  -10),
        (-20,  10,  -10),
        (20,  -10,   10),
        (-20, -10,   10),

        (45,   0,    0),
        (-45,  0,    0)
    ]

    for track in track_candidates:
        for d1, d2, d3 in deg_offsets:
            joints = list(base_joints)

            joints[0] = angle_wrap_pi(joints[0] + math.radians(d1))
            joints[1] = angle_wrap_pi(joints[1] + math.radians(d2))
            joints[2] = angle_wrap_pi(joints[2] + math.radians(d3))

            seeds.append((track, joints))

    unique = []
    seen = set()

    for track, joints in seeds:
        key = (
            round(track, 3),
            round(joints[0], 3),
            round(joints[1], 3),
            round(joints[2], 3)
        )

        if key not in seen:
            seen.add(key)
            unique.append((track, joints))

    return unique


def damp_track_column_if_at_limit(J, q, names):
    """
    If the track is near either limit, reduce the track column in the Jacobian.
    This forces the solver to rely more on J1-J6.
    """
    if not names:
        return J

    if names[0] != "track_joint":
        return J

    track = q[0]

    if track < 0.04 or track > 0.96:
        scale = 0.10

    elif track < 0.10 or track > 0.90:
        scale = 0.35

    else:
        scale = 1.0

    if scale < 1.0:
        for r in range(len(J)):
            J[r][0] *= scale

    return J


def limit_aware_step(dq, q, names):
    """
    Prevent the track update from pushing farther into a hard limit.
    The arm joints remain free.
    """
    if not names:
        return dq

    if names[0] != "track_joint":
        return dq

    track = q[0]

    if track <= 0.005 and dq[0] < 0.0:
        dq[0] = 0.0

    if track >= 0.995 and dq[0] > 0.0:
        dq[0] = 0.0

    if track < 0.06 and dq[0] < 0.0:
        dq[0] *= 0.15

    if track > 0.94 and dq[0] > 0.0:
        dq[0] *= 0.15

    return dq


# ------------------------------------------------------------
# IK solver
# ------------------------------------------------------------

def solve_target_single_seed(
    model,
    joint_info,
    tool_link,
    target_plane,
    seed_track_m,
    seed_joints_rad,
    tool_z,
    use_track,
    max_iter,
    tolerance,
    deadline_time
):
    """
    Solve one target from one seed.
    """
    rot_weight = 0.16
    damping = 0.05

    names = active_joint_names(use_track)
    lower, upper = get_bounds(joint_info, names)

    if use_track:
        q = [seed_track_m] + list(seed_joints_rad[:6])
    else:
        q = list(seed_joints_rad[:6])

    q = bound_q(q, lower, upper)

    best_error = 999999.0
    best_track = seed_track_m
    best_joints = list(seed_joints_rad[:6])
    best_plane = rg.Plane.Unset
    best_iteration = 0

    previous_error = None
    stagnant_count = 0

    for iteration in range(max_iter):
        check_deadline(deadline_time)

        track_m, joints_rad = unpack_q(q, seed_track_m, use_track)
        config = make_config(model, track_m, joints_rad)

        tcp_plane = current_tcp_plane(model, config, tool_link, tool_z)

        if tcp_plane is None:
            return (
                False,
                seed_track_m,
                seed_joints_rad,
                999999.0,
                rg.Plane.Unset,
                iteration
            )

        err = plane_error(tcp_plane, target_plane, rot_weight)
        en = error_norm(err)

        if en < best_error:
            best_error = en
            best_track = track_m
            best_joints = list(joints_rad)
            best_plane = tcp_plane
            best_iteration = iteration

        if en < tolerance:
            return (
                True,
                track_m,
                joints_rad,
                en,
                tcp_plane,
                iteration
            )

        if previous_error is not None:
            if abs(previous_error - en) < 0.00002:
                stagnant_count += 1
            else:
                stagnant_count = 0

            if stagnant_count >= 8:
                break

        previous_error = en

        J = build_geometric_jacobian(
            model,
            config,
            joint_info,
            names,
            tcp_plane.Origin
        )

        J = damp_track_column_if_at_limit(J, q, names)

        dq = damped_least_squares(J, err, damping)

        dq = limit_aware_step(dq, q, names)

        for i in range(len(dq)):
            joint_name = names[i]

            if joint_name == "track_joint":
                dq[i] = clamp(dq[i], -0.030, 0.030)
            else:
                dq[i] = clamp(dq[i], -0.080, 0.080)

        for i in range(len(q)):
            q[i] += dq[i]

        q = bound_q(q, lower, upper)

    return (
        best_error < tolerance,
        best_track,
        best_joints,
        best_error,
        best_plane,
        best_iteration
    )


def solve_target(
    model,
    joint_info,
    tool_link,
    target_plane,
    seed_track_m,
    seed_joints_rad,
    tool_z,
    use_track,
    deadline_time
):
    """
    Track-aware multi-seed IK.

    First tries the sequential seed.
    If that fails, retries the same TCP target with alternate J1/J2/J3
    postures and inward track positions.
    """
    tolerance = 0.006

    ok, track_m, joints_rad, err, tcp_plane, iterations = solve_target_single_seed(
        model=model,
        joint_info=joint_info,
        tool_link=tool_link,
        target_plane=target_plane,
        seed_track_m=seed_track_m,
        seed_joints_rad=seed_joints_rad,
        tool_z=tool_z,
        use_track=use_track,
        max_iter=45,
        tolerance=tolerance,
        deadline_time=deadline_time
    )

    if ok:
        return ok, track_m, joints_rad, err, tcp_plane, iterations

    seeds = make_reposture_seeds(
        seed_track_m,
        seed_joints_rad,
        use_track
    )

    best_ok = ok
    best_track = track_m
    best_joints = joints_rad
    best_error = err
    best_plane = tcp_plane
    best_iterations = iterations

    for alt_track, alt_joints in seeds:
        check_deadline(deadline_time)

        ok2, track2, joints2, err2, plane2, it2 = solve_target_single_seed(
            model=model,
            joint_info=joint_info,
            tool_link=tool_link,
            target_plane=target_plane,
            seed_track_m=alt_track,
            seed_joints_rad=alt_joints,
            tool_z=tool_z,
            use_track=use_track,
            max_iter=35,
            tolerance=tolerance,
            deadline_time=deadline_time
        )

        if err2 < best_error:
            best_ok = ok2
            best_track = track2
            best_joints = joints2
            best_error = err2
            best_plane = plane2
            best_iterations = it2

        if ok2:
            return ok2, track2, joints2, err2, plane2, it2

    return (
        best_ok,
        best_track,
        best_joints,
        best_error,
        best_plane,
        best_iterations
    )


# ------------------------------------------------------------
# Calibration frame conversion
# ------------------------------------------------------------

def normalize_signs(vals):
    out = []
    for i in range(6):
        v = 1.0
        if vals and i < len(vals):
            v = vals[i]
        if v < 0:
            out.append(-1.0)
        else:
            out.append(1.0)
    return out


def get_joint_frame_settings():
    """
    Returns:
      use_frame: bool
      home_urdf_deg: list[6]
      joint_signs: list[6]
      warnings: list[str]
      source: str

    home_urdf_deg is the true URDF pose of firmware A0 B0 C0 D0 E0 F0.
    This is NOT necessarily the raw limit switch pose.
    """
    warnings = []

    # Default OFF: Annin RJ degrees match DH / URDF geometric degrees.
    use_frame = to_bool(get_optional_input("UseCalibrationFrame", False), False)

    home_input = parse_float_list_input(
        get_optional_input("HomeJointsDeg", None),
        count=6,
        default=None
    )

    source = "HomeJointsDeg input"

    if home_input is None and sc is not None:
        sticky_home = sc.sticky.get("AR4_HOME_URDF_DEG", None)
        home_input = parse_float_list_input(sticky_home, count=6, default=None)
        if home_input is not None:
            source = "sc.sticky['AR4_HOME_URDF_DEG']"

    if home_input is None:
        home_input = list(DEFAULT_HOME_URDF_DEG)
        source = "default zero home (Annin DH == firmware)"
        if use_frame:
            warnings.append(
                "UseCalibrationFrame=True but HomeJointsDeg is unset. "
                "Using [0,0,0,0,0,0]. Set HomeJointsDeg only after FK gold measurement."
            )

    signs_input = parse_float_list_input(
        get_optional_input("JointSigns", None),
        count=6,
        default=None
    )

    if signs_input is None and sc is not None:
        signs_input = parse_float_list_input(
            sc.sticky.get("AR4_JOINT_SIGNS", None),
            count=6,
            default=None
        )

    if signs_input is None:
        signs_input = list(DEFAULT_JOINT_SIGNS)

    joint_signs = normalize_signs(signs_input)

    return use_frame, home_input[:6], joint_signs, warnings, source


def firmware_deg_to_urdf_deg(firmware_deg, home_urdf_deg, joint_signs, use_frame):
    """
    Converts firmware RP/readback angles into true URDF/COMPAS angles.

    If firmware zero is calibrated HOME:
        URDF = HOME_URDF + firmware / sign
    """
    vals = list(firmware_deg[:6])
    while len(vals) < 6:
        vals.append(0.0)

    if not use_frame:
        return vals[:6]

    out = []
    for i in range(6):
        s = joint_signs[i]
        if abs(s) < 1e-12:
            s = 1.0
        out.append(home_urdf_deg[i] + vals[i] / s)
    return out


def urdf_deg_to_firmware_deg(urdf_deg, home_urdf_deg, joint_signs, use_frame):
    """
    Converts true URDF/COMPAS angles into firmware RJ command angles.

    If firmware zero is calibrated HOME:
        firmware = (URDF - HOME_URDF) * sign
    """
    vals = list(urdf_deg[:6])
    while len(vals) < 6:
        vals.append(0.0)

    if not use_frame:
        return vals[:6]

    out = []
    for i in range(6):
        out.append((vals[i] - home_urdf_deg[i]) * joint_signs[i])
    return out


# ------------------------------------------------------------
# Track conversion and command formatting
# ------------------------------------------------------------

def track_m_to_j7_mm(track_m, track_length_mm, track_firmware_inverted):
    """
    Converts URDF/COMPAS TrackM to firmware J7 command units.

    Default (TrackFirmwareInverted=False):
        TrackM=0.0 motor / home-switch side -> J7=0
        TrackM=1.0 far end                  -> J7=TrackLengthMM
        J7_mm = TrackM * TrackLengthMM

    If TrackFirmwareInverted=True:
        J7_mm = (1 - TrackM) * TrackLengthMM
    """
    t = clamp(track_m, 0.0, 1.0)
    if track_firmware_inverted:
        return (1.0 - t) * track_length_mm
    return t * track_length_mm


def j7_mm_to_track_m(j7_mm, track_length_mm, track_firmware_inverted):
    if abs(track_length_mm) < 1e-9:
        track_length_mm = 1000.0

    v = clamp(float(j7_mm) / float(track_length_mm), 0.0, 1.0)

    if track_firmware_inverted:
        return 1.0 - v
    return v


def get_track_settings():
    track_length_mm = to_float(get_optional_input("TrackLengthMM", 1000.0), 1000.0)
    if track_length_mm <= 0.0:
        track_length_mm = 1000.0

    # Default False: TrackM maps directly to J7 mm / length.
    track_firmware_inverted = to_bool(
        get_optional_input("TrackFirmwareInverted", False),
        False
    )

    return track_length_mm, track_firmware_inverted


def build_rj_command(
    track_m,
    joints_rad,
    speed,
    accel,
    decel,
    ramp,
    wrist,
    home_urdf_deg,
    joint_signs,
    use_calibration_frame,
    track_length_mm,
    track_firmware_inverted,
    speed_type="m"
):
    """
    Converts true URDF TrackM + J1-J6 radians to firmware RJ command.

    Outputs:
      cmd
      j7_mm
      joints_urdf_deg
      joints_firmware_deg
    """
    track_m = clamp(track_m, 0.0, 1.0)

    j7_mm = track_m_to_j7_mm(
        track_m,
        track_length_mm,
        track_firmware_inverted
    )

    joints_urdf_deg = [math.degrees(v) for v in joints_rad[:6]]

    while len(joints_urdf_deg) < 6:
        joints_urdf_deg.append(0.0)

    joints_firmware_deg = urdf_deg_to_firmware_deg(
        joints_urdf_deg,
        home_urdf_deg,
        joint_signs,
        use_calibration_frame
    )

    j1, j2, j3, j4, j5, j6 = joints_firmware_deg[:6]

    if not wrist:
        wrist = "F"

    speed_type = str(speed_type).strip().lower()
    if speed_type not in ["m", "p", "s"]:
        speed_type = "m"

    loop_mode = "000000"

    cmd = (
        "RJ"
        "A{j1:.3f}"
        "B{j2:.3f}"
        "C{j3:.3f}"
        "D{j4:.3f}"
        "E{j5:.3f}"
        "F{j6:.3f}"
        "J7{j7:.3f}"
        "J8{j8:.3f}"
        "J9{j9:.3f}"
        "S{speed_type}{speed:.3f}"
        "Ac{accel:.3f}"
        "Dc{decel:.3f}"
        "Rm{ramp:.3f}"
        "W{wrist}"
        "Lm{loop_mode}"
    ).format(
        j1=j1,
        j2=j2,
        j3=j3,
        j4=j4,
        j5=j5,
        j6=j6,
        j7=j7_mm,
        j8=0.0,
        j9=0.0,
        speed_type=speed_type,
        speed=speed,
        accel=accel,
        decel=decel,
        ramp=ramp,
        wrist=wrist,
        loop_mode=loop_mode
    )

    return cmd, j7_mm, joints_urdf_deg, joints_firmware_deg


# ------------------------------------------------------------
# Seed and calibration readback conversion
# ------------------------------------------------------------

def get_seed_from_calibration(
    home_urdf_deg,
    joint_signs,
    use_calibration_frame,
    track_length_mm,
    track_firmware_inverted
):
    """
    Uses the most recent Calibration component RP/LL state as the starting pose.

    This function treats calibration readback as firmware-space unless the
    calibration component explicitly stored urdf_joint_values_rad or
    urdf_joint_values_deg.

    If no calibration state exists:
      - track starts at motor/home side: TrackM=0.0 (non-inverted default)
      - joints start at URDF zero (same as firmware zero with UseCalibrationFrame=False)
    """
    seed_track_m = 0.0 if not track_firmware_inverted else 1.0

    if use_calibration_frame:
        seed_joints_rad = [math.radians(v) for v in home_urdf_deg]
    else:
        seed_joints_rad = [0.0] * 6

    seed_source = "default"

    if sc is None:
        return seed_track_m, seed_joints_rad, seed_source

    state = sc.sticky.get("AR4_LAST_CALIBRATION_STATE", None)

    if isinstance(state, dict):
        # Track: prefer explicit track_m; otherwise convert j7_mm.
        if "track_m" in state:
            seed_track_m = to_float(state.get("track_m"), seed_track_m)
        elif "j7_mm" in state:
            seed_track_m = j7_mm_to_track_m(
                to_float(state.get("j7_mm"), 0.0),
                track_length_mm,
                track_firmware_inverted
            )

        # Joints: prefer explicit URDF-space values if calibration component has them.
        urdf_rad = None
        try:
            vals = list(state.get("urdf_joint_values_rad", []))
            if len(vals) >= 6:
                urdf_rad = [to_float(v, 0.0) for v in vals[:6]]
                seed_source = "calibration urdf_joint_values_rad"
        except Exception:
            pass

        if urdf_rad is None:
            try:
                vals = list(state.get("urdf_joint_values_deg", []))
                if len(vals) >= 6:
                    urdf_deg = [to_float(v, 0.0) for v in vals[:6]]
                    urdf_rad = [math.radians(v) for v in urdf_deg]
                    seed_source = "calibration urdf_joint_values_deg"
            except Exception:
                pass

        # Backward-compatible path: existing calibration script likely stored
        # joint_values_deg/rad directly from firmware RP. Treat degrees as firmware.
        if urdf_rad is None:
            firmware_deg = None

            try:
                vals = list(state.get("firmware_joint_values_deg", []))
                if len(vals) >= 6:
                    firmware_deg = [to_float(v, 0.0) for v in vals[:6]]
            except Exception:
                pass

            if firmware_deg is None:
                try:
                    vals = list(state.get("joint_values_deg", []))
                    if len(vals) >= 6:
                        firmware_deg = [to_float(v, 0.0) for v in vals[:6]]
                except Exception:
                    pass

            if firmware_deg is None:
                try:
                    vals = list(state.get("joint_values_rad", []))
                    if len(vals) >= 6:
                        firmware_deg = [math.degrees(to_float(v, 0.0)) for v in vals[:6]]
                except Exception:
                    pass

            if firmware_deg is not None:
                urdf_deg = firmware_deg_to_urdf_deg(
                    firmware_deg,
                    home_urdf_deg,
                    joint_signs,
                    use_calibration_frame
                )
                urdf_rad = [math.radians(v) for v in urdf_deg]
                seed_source = "calibration firmware readback converted to URDF"

        if urdf_rad is not None:
            seed_joints_rad = urdf_rad[:6]

    seed_track_m = clamp(seed_track_m, 0.0, 1.0)

    while len(seed_joints_rad) < 6:
        seed_joints_rad.append(0.0)

    return seed_track_m, seed_joints_rad[:6], seed_source


# ------------------------------------------------------------
# Sticky program storage
# ------------------------------------------------------------

def load_last_outputs():
    if sc is None:
        return None

    state = sc.sticky.get("AR4_LAST_PROGRAM_OUTPUTS", None)

    if isinstance(state, dict):
        return state

    return None


def save_outputs(data):
    if sc is None:
        return

    sc.sticky["AR4_LAST_PROGRAM_OUTPUTS"] = data

    sc.sticky["AR4_LAST_PROGRAM_STATE"] = data.get("program_state", {})
    sc.sticky["AR4_LAST_PROGRAM_COMMANDS"] = data.get("rj_commands", [])
    sc.sticky["AR4_LAST_PROGRAM_TRACK_M"] = data.get("program_track_m", [])
    sc.sticky["AR4_LAST_PROGRAM_J7_MM"] = data.get("program_j7_mm", [])
    sc.sticky["AR4_LAST_PROGRAM_JOINTS_RAD"] = data.get("program_joint_values_rad", [])
    sc.sticky["AR4_LAST_PROGRAM_JOINTS_DEG"] = data.get("program_joint_values_deg", [])
    sc.sticky["AR4_LAST_PROGRAM_FIRMWARE_JOINTS_DEG"] = data.get("program_firmware_joint_values_deg", [])
    sc.sticky["AR4_LAST_PROGRAM_TCP_PLANES"] = data.get("tcp_planes_solved", [])
    sc.sticky["AR4_LAST_PROGRAM_TARGET_PLANES"] = data.get("target_planes_robot", [])
    sc.sticky["AR4_LAST_PROGRAM_COMMAND_METADATA"] = data.get("command_metadata", [])


# ------------------------------------------------------------
# Outputs / defaults
# ------------------------------------------------------------

solved = []
program_joint_values_rad = []
program_joint_values_deg = []
program_track_m = []
program_j7_mm = []
rj_commands = []
ik_errors = []
target_planes_robot = []
tcp_planes_solved = []
program_state = {}
status = ""


# ------------------------------------------------------------
# Main
# ------------------------------------------------------------

try:
    if sc is None:
        raise Exception("scriptcontext is not available.")

    cid = to_text(cache_id, "").strip()

    if not cid or cid == "None":
        raise Exception("No cache_id provided. Connect cache_id from Startup.")

    model = sc.sticky.get(cid + "::model", None)

    if model is None:
        raise Exception("No cached robot model found. Run Startup first.")

    raw_targets = flatten_targets(Targets)

    solve_now = to_bool(Solve, False)
    use_track = to_bool(UseTrack, True)

    # Optional settings. These can be added as GH inputs without breaking older files.
    max_solve_seconds = to_float(get_optional_input("MaxSolveSeconds", 300.0), 300.0)
    if max_solve_seconds <= 0.0:
        max_solve_seconds = 300.0

    # Default False: one RJ per target moves arm + J7 together for smooth TCP.
    # True restores legacy track-first preposition (not synchronized).
    split_track_motion = to_bool(get_optional_input("SplitTrackMotion", False), False)
    track_speed_percent = to_float(get_optional_input("TrackSpeedPercent", 100.0), 100.0)
    track_speed_percent = clamp(track_speed_percent, 1.0, 100.0)
    track_move_epsilon_mm = to_float(get_optional_input("TrackMoveEpsilonMM", 0.5), 0.5)
    if track_move_epsilon_mm < 0.0:
        track_move_epsilon_mm = 0.5

    track_length_mm, track_firmware_inverted = get_track_settings()

    (
        use_calibration_frame,
        home_urdf_deg,
        joint_signs,
        frame_warnings,
        home_source
    ) = get_joint_frame_settings()

    # Edge-trigger Solve.
    edge_key = "AR4_PROGRAM_SOLVE_LAST_STATE"
    previous_solve = sc.sticky.get(edge_key, False)
    sc.sticky[edge_key] = solve_now

    last = load_last_outputs()

    if not raw_targets:
        status = "No target TCP planes provided."

    elif not solve_now:
        if last:
            solved = last.get("solved", [])
            program_joint_values_rad = last.get("program_joint_values_rad", [])
            program_joint_values_deg = last.get("program_joint_values_deg", [])
            program_track_m = last.get("program_track_m", [])
            program_j7_mm = last.get("program_j7_mm", [])
            rj_commands = last.get("rj_commands", [])
            ik_errors = last.get("ik_errors", [])
            program_state = last.get("program_state", {})

            # Sticky stores meter planes; GH outputs should be Rhino mm.
            disp = 1000.0
            if isinstance(program_state, dict):
                ts = to_float(program_state.get("target_scale"), 0.001)
                if abs(ts) > 1e-12:
                    disp = 1.0 / ts
            target_planes_robot = [
                scale_plane_origin(pl, disp) if isinstance(pl, rg.Plane) else pl
                for pl in last.get("target_planes_robot", [])
            ]
            tcp_planes_solved = [
                scale_plane_origin(pl, disp) if isinstance(pl, rg.Plane) else pl
                for pl in last.get("tcp_planes_solved", [])
            ]

            status = "Solve=False. Holding last program with {} command(s).".format(
                len(rj_commands)
            )

        else:
            status = "Ready. {} TCP target plane(s) loaded. Toggle Solve=True to generate commands.".format(
                len(raw_targets)
            )

    elif previous_solve:
        if last:
            solved = last.get("solved", [])
            program_joint_values_rad = last.get("program_joint_values_rad", [])
            program_joint_values_deg = last.get("program_joint_values_deg", [])
            program_track_m = last.get("program_track_m", [])
            program_j7_mm = last.get("program_j7_mm", [])
            rj_commands = last.get("rj_commands", [])
            ik_errors = last.get("ik_errors", [])
            program_state = last.get("program_state", {})

            disp = 1000.0
            if isinstance(program_state, dict):
                ts = to_float(program_state.get("target_scale"), 0.001)
                if abs(ts) > 1e-12:
                    disp = 1.0 / ts
            target_planes_robot = [
                scale_plane_origin(pl, disp) if isinstance(pl, rg.Plane) else pl
                for pl in last.get("target_planes_robot", [])
            ]
            tcp_planes_solved = [
                scale_plane_origin(pl, disp) if isinstance(pl, rg.Plane) else pl
                for pl in last.get("tcp_planes_solved", [])
            ]

            status = "Solve is still True. Not recomputing. Toggle Solve False, then True to resolve."

        else:
            status = "Solve is True, but no previous program exists. Toggle Solve False, then True."

    else:
        deadline_time = time.time() + max_solve_seconds

        urdf_path = get_urdf_path_from_cache(cid)
        joint_info = get_joint_info(cid, urdf_path)

        if not joint_info:
            raise Exception(
                "Could not parse/cache URDF motion joints from: {}".format(
                    urdf_path
                )
            )

        tool_link = choose_tool_link(model)

        if not tool_link:
            raise Exception("Could not identify tool link.")

        tool_z_mm = to_float(ToolZ, 0.0)
        speed = to_float(Speed, 5.0)
        accel = to_float(Accel, 5.0)
        decel = to_float(Decel, 5.0)
        ramp = to_float(Ramp, 10.0)
        wrist = to_text(Wrist, "F")

        target_units_mm = to_bool(get_optional_input("TargetUnitsMM", True), True)
        target_scale = guess_target_scale(raw_targets, force_mm=target_units_mm)
        targets = [scale_plane_origin(pl, target_scale) for pl in raw_targets]

        # ToolZ is authored in millimeters when TargetUnitsMM=True.
        tool_z = tool_z_mm * target_scale

        seed_track_m, seed_joints_rad, seed_source = get_seed_from_calibration(
            home_urdf_deg,
            joint_signs,
            use_calibration_frame,
            track_length_mm,
            track_firmware_inverted
        )

        current_track = seed_track_m
        current_joints = list(seed_joints_rad)
        current_j7_mm = track_m_to_j7_mm(
            current_track,
            track_length_mm,
            track_firmware_inverted
        )

        failures = 0
        command_metadata = []
        program_firmware_joint_values_deg = []

        for target_index, target in enumerate(targets):
            check_deadline(deadline_time)

            target_planes_robot.append(target)

            ok, track_m, joints_rad, err, tcp_plane, iterations = solve_target(
                model=model,
                joint_info=joint_info,
                tool_link=tool_link,
                target_plane=target,
                seed_track_m=current_track,
                seed_joints_rad=current_joints,
                tool_z=tool_z,
                use_track=use_track,
                deadline_time=deadline_time
            )

            # Build final arm/track command from solved URDF pose.
            cmd, j7, joints_urdf_deg, joints_fw_deg = build_rj_command(
                track_m=track_m,
                joints_rad=joints_rad,
                speed=speed,
                accel=accel,
                decel=decel,
                ramp=ramp,
                wrist=wrist,
                home_urdf_deg=home_urdf_deg,
                joint_signs=joint_signs,
                use_calibration_frame=use_calibration_frame,
                track_length_mm=track_length_mm,
                track_firmware_inverted=track_firmware_inverted,
                speed_type="m"
            )

            # Optional legacy behavior: move J7 alone first, then the arm.
            # Default is synchronized: one RJ moves joints + J7 together so the
            # TCP can progress continuously through the target sequence.
            if (
                split_track_motion
                and use_track
                and abs(j7 - current_j7_mm) > track_move_epsilon_mm
            ):
                track_cmd, track_j7, track_urdf_deg, track_fw_deg = build_rj_command(
                    track_m=track_m,
                    joints_rad=current_joints,
                    speed=track_speed_percent,
                    accel=accel,
                    decel=decel,
                    ramp=ramp,
                    wrist=wrist,
                    home_urdf_deg=home_urdf_deg,
                    joint_signs=joint_signs,
                    use_calibration_frame=use_calibration_frame,
                    track_length_mm=track_length_mm,
                    track_firmware_inverted=track_firmware_inverted,
                    speed_type="p"
                )

                rj_commands.append(track_cmd)
                command_metadata.append({
                    "target_index": target_index,
                    "type": "track_preposition",
                    "speed_type": "p",
                    "speed": track_speed_percent,
                    "track_m": track_m,
                    "j7_mm": track_j7,
                    "urdf_joint_values_deg": track_urdf_deg,
                    "urdf_joint_values_rad": list(current_joints),
                    "firmware_joint_values_deg": track_fw_deg
                })

            rj_commands.append(cmd)
            command_metadata.append({
                "target_index": target_index,
                "type": "track_preposition_followup" if split_track_motion else "synchronized_target",
                "speed_type": "m",
                "speed": speed,
                "track_m": track_m,
                "j7_mm": j7,
                "urdf_joint_values_deg": joints_urdf_deg,
                "urdf_joint_values_rad": list(joints_rad),
                "firmware_joint_values_deg": joints_fw_deg,
                "synchronized_track_and_arm": not split_track_motion
            })

            solved.append(ok)
            program_track_m.append(track_m)
            program_j7_mm.append(j7)
            program_joint_values_rad.append(joints_rad)
            program_joint_values_deg.append(joints_urdf_deg)
            program_firmware_joint_values_deg.append(joints_fw_deg)
            ik_errors.append(err)
            tcp_planes_solved.append(tcp_plane)

            if not ok:
                failures += 1

            # Sequential solving:
            # each target uses the previous solved URDF pose as its next seed.
            current_track = track_m
            current_joints = list(joints_rad)
            current_j7_mm = j7

        program_state = {
            "target_count": len(targets),
            "command_count": len(rj_commands),
            "failures": failures,
            "tool_link": tool_link,
            "tool_z": tool_z,
            "tool_z_mm": tool_z_mm,
            "target_units_mm": target_units_mm,
            "use_track": use_track,
            "speed": speed,
            "accel": accel,
            "decel": decel,
            "ramp": ramp,
            "wrist": wrist,
            "target_scale": target_scale,
            "display_scale": (1.0 / target_scale) if abs(target_scale) > 1e-12 else 1.0,
            "urdf_path": urdf_path,
            "motion_joint_names": MOTION_JOINT_NAMES,
            "seed_track_m": seed_track_m,
            "seed_joint_values_rad": seed_joints_rad,
            "seed_source": seed_source,
            "track_limit_reposture_enabled": True,
            "split_track_motion": split_track_motion,
            "track_speed_percent": track_speed_percent,
            "track_move_epsilon_mm": track_move_epsilon_mm,
            "track_firmware_inverted": track_firmware_inverted,
            "track_length_mm": track_length_mm,
            "use_calibration_frame": use_calibration_frame,
            "home_urdf_deg": home_urdf_deg,
            "home_source": home_source,
            "joint_signs": joint_signs,
            "frame_warnings": frame_warnings,
            "max_solve_seconds": max_solve_seconds,
            "program_firmware_joint_values_deg": program_firmware_joint_values_deg,
            "command_metadata": command_metadata
        }

        output_data = {
            "solved": solved,
            "program_joint_values_rad": program_joint_values_rad,
            "program_joint_values_deg": program_joint_values_deg,
            "program_track_m": program_track_m,
            "program_j7_mm": program_j7_mm,
            "rj_commands": rj_commands,
            "ik_errors": ik_errors,
            "target_planes_robot": target_planes_robot,
            "tcp_planes_solved": tcp_planes_solved,
            "program_state": program_state,
            "program_firmware_joint_values_deg": program_firmware_joint_values_deg,
            "command_metadata": command_metadata
        }

        save_outputs(output_data)

        # Sticky keeps model-meter planes for Comp4 FK.
        # GH outputs are converted back to Rhino millimeters for overlay.
        display_scale = 1.0 / target_scale if abs(target_scale) > 1e-12 else 1.0
        if abs(display_scale - 1.0) > 1e-12:
            target_planes_robot = [scale_plane_origin(pl, display_scale) for pl in target_planes_robot]
            tcp_planes_solved = [
                scale_plane_origin(pl, display_scale) if isinstance(pl, rg.Plane) else pl
                for pl in tcp_planes_solved
            ]

        if failures == 0:
            status = (
                "Solved {} TCP target(s). Generated {} RJ command(s). "
                "Motion: {}. Target scale: {}. "
                "Calibration-frame conversion: {}. "
                "Home source: {}. Seed source: {}. "
                "Toggle Solve False before resolving."
            ).format(
                len(targets),
                len(rj_commands),
                "split track-then-arm" if split_track_motion else "synchronized arm+J7",
                target_scale,
                use_calibration_frame,
                home_source,
                seed_source
            )
        else:
            status = (
                "Generated {} RJ command(s), but {} target(s) exceeded tolerance. "
                "Motion: {}. Target scale: {}. Calibration-frame conversion: {}. "
                "Home source: {}. Check ik_errors and tcp_planes_solved."
            ).format(
                len(rj_commands),
                failures,
                "split track-then-arm" if split_track_motion else "synchronized arm+J7",
                target_scale,
                use_calibration_frame,
                home_source
            )

        if frame_warnings:
            status += " WARNING: " + " | ".join(frame_warnings)

except Exception as e:
    solved = []
    program_joint_values_rad = []
    program_joint_values_deg = []
    program_track_m = []
    program_j7_mm = []
    rj_commands = []
    ik_errors = []
    target_planes_robot = []
    tcp_planes_solved = []
    program_state = {}
    status = "ERROR: {}".format(e)
# ---------- end ar4_program ----------
commands = Merge(Data1=panel, Data2=flatten(ar4_program.rj_commands), Data3=panel)  # -> flatten(Result)
ar4_simulation = Python3Script(
    Commands=commands,
    Time=Slider(0, range=0..1),
    DrawRobot=Toggle(True),
    DrawTrack=Toggle(True),
    DrawPath=Toggle(True),
    DrawTargets=Toggle(True),
    DrawSkeleton=Toggle(True))  # -> active_command, robot_geometry, track_geometry, skeleton_lines, simulation_state, status; inputs Commands: list
# ---------- ar4_simulation: Python ----------
#! python3
# r: compas
# r: compas_fab
# r: compas_robots

import math

import Rhino.Geometry as rg

try:
    import scriptcontext as sc
except Exception:
    sc = None


# ------------------------------------------------------------
# Helpers: Grasshopper values
# ------------------------------------------------------------

def unwrap_gh(value):
    if value is None:
        return None

    if hasattr(value, "Value"):
        return value.Value

    return value


def to_bool(value, default=False):
    value = unwrap_gh(value)

    if value is None:
        return default

    if isinstance(value, bool):
        return value

    return str(value).strip().lower() in ["true", "1", "yes", "y"]


def to_float(value, default=0.0):
    value = unwrap_gh(value)

    if value is None:
        return default

    try:
        return float(value)
    except Exception:
        try:
            return float(str(value).strip())
        except Exception:
            return default


def clamp(value, low, high):
    if value < low:
        return low

    if value > high:
        return high

    return value


def to_command_list(values):
    """
    Accept a Grasshopper list, a single command string, or multiline text.
    Return a clean list of RJ command strings.
    """
    if values is None:
        return []

    values = unwrap_gh(values)

    try:
        raw = list(values)
    except TypeError:
        raw = [values]

    result = []

    for item in raw:
        item = unwrap_gh(item)

        if item is None:
            continue

        s = str(item).strip()

        if not s:
            continue

        # Allow one panel with many commands.
        if "\n" in s:
            for line in s.splitlines():
                line = line.strip()

                if line:
                    result.append(line)
        else:
            result.append(s)

    # Keep only likely RJ commands.
    cleaned = []

    for cmd in result:
        if cmd.strip().upper().startswith("RJ"):
            cleaned.append(cmd.strip())

    return cleaned


# ------------------------------------------------------------
# Helpers: cached startup model
# ------------------------------------------------------------

def cache_timestamp_from_id(cache_id):
    try:
        return int(str(cache_id).split("_")[-1])
    except Exception:
        return 0


def find_latest_startup_cache():
    """
    Startup component stores:
      <cache_id>::model
      <cache_id>::meshes

    This searches sticky and returns the newest cache_id.
    """
    if sc is None:
        return None, None, None

    candidates = []

    try:
        keys = list(sc.sticky.keys())
    except Exception:
        keys = []

    for key in keys:
        k = str(key)

        if k.startswith("AR4_STARTUP_") and k.endswith("::model"):
            cid = k.replace("::model", "")
            model = sc.sticky.get(cid + "::model", None)

            if model is not None:
                candidates.append((cache_timestamp_from_id(cid), cid, model))

    if not candidates:
        return None, None, None

    candidates.sort()
    _, cid, model = candidates[-1]

    meshes = sc.sticky.get(cid + "::meshes", {})

    return cid, model, meshes


# ------------------------------------------------------------
# Helpers: command parsing
# ------------------------------------------------------------

def between(s, start_token, end_token=None):
    start = s.find(start_token)

    if start < 0:
        return ""

    start += len(start_token)

    if end_token is None:
        return s[start:].strip()

    end = s.find(end_token, start)

    if end < 0:
        return s[start:].strip()

    return s[start:end].strip()


def parse_rj_command(command, track_length_mm=1000.0, track_firmware_inverted=False):
    """
    Parse firmware RJ command for fallback only.

    Prefer Comp3 sticky command_metadata (URDF joints + TrackM) for simulation.
    This parser is kept for RJ-only debugging when metadata is unavailable.

    Track convention (default non-inverted):
      TrackM = J7_mm / TrackLengthMM
    """

    result = {
        "valid": False,
        "command": command,
        "joints_deg": [0.0] * 6,
        "joints_rad": [0.0] * 6,
        "j7_mm": 0.0,
        "track_m": 0.0,
        "j8": 0.0,
        "j9": 0.0,
        "speed": 0.0,
        "accel": 0.0,
        "decel": 0.0,
        "ramp": 0.0,
        "wrist": "",
        "loop_mode": "",
        "source": "rj_parse"
    }

    if command is None:
        return result

    s = str(command).strip()

    if not s.upper().startswith("RJ"):
        return result

    try:
        j1 = to_float(between(s, "A", "B"))
        j2 = to_float(between(s, "B", "C"))
        j3 = to_float(between(s, "C", "D"))
        j4 = to_float(between(s, "D", "E"))
        j5 = to_float(between(s, "E", "F"))
        j6 = to_float(between(s, "F", "J7"))

        j7 = to_float(between(s, "J7", "J8"))
        j8 = to_float(between(s, "J8", "J9"))
        j9 = to_float(between(s, "J9", "S"))

        speed = to_float(between(s, "Sm", "Ac"))
        if abs(speed) < 1e-12:
            speed = to_float(between(s, "Sp", "Ac"))
        accel = to_float(between(s, "Ac", "Dc"))
        decel = to_float(between(s, "Dc", "Rm"))

        # Some commands may have Rnd in other branches, but our RJ builder uses Rm directly before W.
        if "Rnd" in s:
            ramp = to_float(between(s, "Rm", "Rnd"))
            wrist = between(s, "W", "Lm")
        else:
            ramp = to_float(between(s, "Rm", "W"))
            wrist = between(s, "W", "Lm")

        loop_mode = between(s, "Lm", None)

        joints_deg = [j1, j2, j3, j4, j5, j6]
        joints_rad = [math.radians(v) for v in joints_deg]

        length = track_length_mm if abs(track_length_mm) > 1e-9 else 1000.0
        track_m = clamp(j7 / length, 0.0, 1.0)
        if track_firmware_inverted:
            track_m = 1.0 - track_m

        result["valid"] = True
        result["joints_deg"] = joints_deg
        result["joints_rad"] = joints_rad
        result["j7_mm"] = j7
        result["track_m"] = track_m
        result["j8"] = j8
        result["j9"] = j9
        result["speed"] = speed
        result["accel"] = accel
        result["decel"] = decel
        result["ramp"] = ramp
        result["wrist"] = wrist
        result["loop_mode"] = loop_mode

        return result

    except Exception:
        return result


def load_program_pose_sequence(commands):
    """
    Build one pose record per RJ command.

    Preferred source: Comp3 sticky command_metadata with URDF joints + TrackM.
    Fallback: parse RJ degrees as URDF (valid only when UseCalibrationFrame=False
    and joint signs are all +1).
    """
    program_state = {}
    if sc is not None:
        state = sc.sticky.get("AR4_LAST_PROGRAM_STATE", {})
        if isinstance(state, dict):
            program_state = state

    track_length_mm = to_float(program_state.get("track_length_mm"), 1000.0)
    track_firmware_inverted = to_bool(program_state.get("track_firmware_inverted"), False)
    tool_z = to_float(program_state.get("tool_z"), 0.0)

    metadata = []
    if sc is not None:
        meta = sc.sticky.get("AR4_LAST_PROGRAM_COMMAND_METADATA", None)
        if isinstance(meta, list):
            metadata = meta
        elif isinstance(program_state.get("command_metadata"), list):
            metadata = program_state.get("command_metadata")

    poses = []

    for i, cmd in enumerate(commands):
        record = {
            "valid": False,
            "command": cmd,
            "joints_deg": [0.0] * 6,
            "joints_rad": [0.0] * 6,
            "track_m": 0.0,
            "j7_mm": 0.0,
            "source": "none"
        }

        if i < len(metadata) and isinstance(metadata[i], dict):
            md = metadata[i]
            joints_rad = None
            try:
                vals = list(md.get("urdf_joint_values_rad", []))
                if len(vals) >= 6:
                    joints_rad = [to_float(v, 0.0) for v in vals[:6]]
            except Exception:
                joints_rad = None

            if joints_rad is None:
                try:
                    vals = list(md.get("urdf_joint_values_deg", []))
                    if len(vals) >= 6:
                        joints_rad = [math.radians(to_float(v, 0.0)) for v in vals[:6]]
                except Exception:
                    joints_rad = None

            if joints_rad is not None:
                track_m = None
                if "track_m" in md and md.get("track_m") is not None:
                    track_m = to_float(md.get("track_m"), 0.0)

                j7_mm = to_float(md.get("j7_mm"), 0.0)
                if track_m is None:
                    track_m = clamp(j7_mm / track_length_mm, 0.0, 1.0)
                    if track_firmware_inverted:
                        track_m = 1.0 - track_m

                record.update({
                    "valid": True,
                    "joints_rad": joints_rad[:6],
                    "joints_deg": [math.degrees(v) for v in joints_rad[:6]],
                    "track_m": clamp(track_m, 0.0, 1.0),
                    "j7_mm": j7_mm,
                    "source": "command_metadata_urdf"
                })
                poses.append(record)
                continue

        parsed = parse_rj_command(cmd, track_length_mm, track_firmware_inverted)
        if parsed["valid"]:
            parsed["source"] = "rj_parse_fallback"
            poses.append(parsed)
        else:
            poses.append(record)

    return poses, tool_z, track_length_mm, track_firmware_inverted, program_state


# ------------------------------------------------------------
# Helpers: COMPAS / Rhino geometry
# ------------------------------------------------------------

def make_config(model, track_m, joints_rad):
    config = model.zero_configuration()

    try:
        configurable = model.get_configurable_joint_names()
    except Exception:
        configurable = []

    if "track_joint" in configurable:
        config["track_joint"] = track_m

    for i in range(6):
        name = "joint_{}".format(i + 1)

        if name in configurable:
            config[name] = joints_rad[i]

    if "gripper_jaw1_joint" in configurable:
        config["gripper_jaw1_joint"] = 0.0

    return config


def safe_fk(model, config, link_name=None):
    try:
        if link_name:
            return model.forward_kinematics(config, link_name=link_name)

        return model.forward_kinematics(config)

    except Exception:
        return None


def frame_to_plane(frame, display_scale=1.0):
    """
    COMPAS frames are in URDF meters. Rhino document units are millimeters,
    so display_scale should normally be 1000.
    """
    p = frame.point
    x = frame.xaxis
    y = frame.yaxis
    s = float(display_scale)

    return rg.Plane(
        rg.Point3d(float(p.x) * s, float(p.y) * s, float(p.z) * s),
        rg.Vector3d(float(x.x), float(x.y), float(x.z)),
        rg.Vector3d(float(y.x), float(y.y), float(y.z))
    )


def frame_point(frame, display_scale=1.0):
    p = frame.point
    s = float(display_scale)
    return rg.Point3d(float(p.x) * s, float(p.y) * s, float(p.z) * s)


def scale_plane_to_display(plane, display_scale):
    if plane is None or not getattr(plane, "IsValid", False):
        return plane
    s = float(display_scale)
    if abs(s - 1.0) < 1e-12:
        return rg.Plane(plane)
    p = rg.Plane(plane)
    p.Origin = rg.Point3d(p.Origin.X * s, p.Origin.Y * s, p.Origin.Z * s)
    return p


def get_display_scale(program_state):
    """
    URDF/COMPAS = meters. Rhino targets in this project = millimeters.
    Display geometry must be scaled back to mm so it overlays Rhino targets.
    """
    if not isinstance(program_state, dict):
        return 1000.0

    if to_bool(program_state.get("target_units_mm"), True):
        return 1000.0

    target_scale = to_float(program_state.get("target_scale"), 0.001)
    if abs(target_scale) > 1e-12 and abs(target_scale - 1.0) > 1e-9:
        return 1.0 / target_scale

    return 1.0


def choose_tool_link(model):
    try:
        link_names = [link.name for link in model.links]
    except Exception:
        link_names = []

    preferred = [
        "tool0",
        "tool_link",
        "pneumatic_gripper_tool_link",
        "ee_link",
        "link_6"
    ]

    for name in preferred:
        if name in link_names:
            return name

    if link_names:
        return link_names[-1]

    return None


def offset_plane_along_z(plane, distance):
    p = rg.Plane(plane)

    z = rg.Vector3d(p.ZAxis)
    if z.Length > 1e-12:
        z.Unitize()

    p.Origin = p.Origin + z * distance

    return p


def link_ref_name(value):
    if value is None:
        return None

    if isinstance(value, str):
        return value

    if hasattr(value, "link"):
        return value.link

    if hasattr(value, "name"):
        return value.name

    return str(value)


def get_frame_by_link(model, config):
    frame_by_link = {}

    try:
        link_names = [link.name for link in model.links]
    except Exception:
        link_names = []

    for name in link_names:
        f = safe_fk(model, config, name)

        if f is not None:
            frame_by_link[name] = f

    return frame_by_link


def draw_robot_meshes(mesh_cache, frame_by_link, display_scale=1.0):
    """
    Mesh geometry is authored in meters. Scale local meshes to display units,
    then place them on display-scaled link planes.
    """
    geometry = []
    s = float(display_scale)
    scale_local = rg.Transform.Scale(rg.Point3d(0.0, 0.0, 0.0), s)

    for link_name, local_meshes in mesh_cache.items():

        if link_name not in frame_by_link:
            continue

        link_plane = frame_to_plane(frame_by_link[link_name], display_scale)
        xform = rg.Transform.PlaneToPlane(rg.Plane.WorldXY, link_plane)

        for base_mesh in local_meshes:
            moved = base_mesh.DuplicateMesh()
            if abs(s - 1.0) > 1e-12:
                moved.Transform(scale_local)
            moved.Transform(xform)
            geometry.append(moved)

    return geometry


def make_box_at_plane(base_plane, center_xyz, size_xyz):
    cx, cy, cz = center_xyz
    sx, sy, sz = size_xyz

    center = (
        base_plane.Origin
        + base_plane.XAxis * cx
        + base_plane.YAxis * cy
        + base_plane.ZAxis * cz
    )

    p = rg.Plane(base_plane)
    p.Origin = center

    box = rg.Box(
        p,
        rg.Interval(-sx / 2.0, sx / 2.0),
        rg.Interval(-sy / 2.0, sy / 2.0),
        rg.Interval(-sz / 2.0, sz / 2.0)
    )

    return box.ToBrep()


def draw_track_proxy(frame_by_link, display_scale=1.0):
    geometry = []
    s = float(display_scale)

    if "track_base_link" in frame_by_link:
        base_plane = frame_to_plane(frame_by_link["track_base_link"], display_scale)
    else:
        base_plane = rg.Plane.WorldXY

    if "track_carriage_link" in frame_by_link:
        carriage_plane = frame_to_plane(frame_by_link["track_carriage_link"], display_scale)
    else:
        carriage_plane = rg.Plane.WorldXY

    # Rail / carriage sizes are defined in meters in the URDF proxy.
    rail = make_box_at_plane(
        base_plane,
        (0.5 * s, 0.0, -0.04 * s),
        (1.05 * s, 0.08 * s, 0.05 * s)
    )

    carriage = make_box_at_plane(
        carriage_plane,
        (0.0, 0.0, -0.005 * s),
        (0.14 * s, 0.14 * s, 0.07 * s)
    )

    geometry.append(rail)
    geometry.append(carriage)

    return geometry


def draw_skeleton_lines(model, frame_by_link, display_scale=1.0):
    lines = []

    try:
        joints = model.joints
    except Exception:
        return lines

    for joint in joints:
        parent_name = link_ref_name(getattr(joint, "parent", None))
        child_name = link_ref_name(getattr(joint, "child", None))

        if parent_name in frame_by_link and child_name in frame_by_link:
            p0 = frame_point(frame_by_link[parent_name], display_scale)
            p1 = frame_point(frame_by_link[child_name], display_scale)

            if p0.DistanceTo(p1) > 1e-6:
                lines.append(rg.Line(p0, p1))

    return lines


def make_path_curve(points):
    if len(points) < 2:
        return None

    poly = rg.Polyline(points)

    return rg.PolylineCurve(poly)


def plane_marker(plane, size):
    """
    Draw plane axes as simple lines.
    X and Y axes are drawn; Z is drawn half-length.
    size is in the same units as plane.Origin (mm when display_scale=1000).
    """
    lines = []

    origin = plane.Origin

    x = rg.Vector3d(plane.XAxis)
    y = rg.Vector3d(plane.YAxis)
    z = rg.Vector3d(plane.ZAxis)

    x.Unitize()
    y.Unitize()
    z.Unitize()

    lines.append(rg.Line(origin, origin + x * size))
    lines.append(rg.Line(origin, origin + y * size))
    lines.append(rg.Line(origin, origin + z * (size * 0.5)))

    return lines


# ------------------------------------------------------------
# Outputs / defaults
# ------------------------------------------------------------

active_index = -1
active_command = None
active_joint_values_deg = []
active_joint_values_rad = []
active_track_m = 0.0
active_j7_mm = 0.0

robot_geometry = []
track_geometry = []
tcp_planes = []
tcp_path = None
target_geometry = []
skeleton_lines = []

simulation_state = {}
status = ""


# ------------------------------------------------------------
# Main
# ------------------------------------------------------------

try:
    if sc is None:
        raise Exception("scriptcontext is not available.")

    commands = to_command_list(Commands)

    draw_robot = to_bool(DrawRobot, True)
    draw_track = to_bool(DrawTrack, True)
    draw_path = to_bool(DrawPath, True)
    draw_targets = to_bool(DrawTargets, True)
    draw_skeleton = to_bool(DrawSkeleton, False)

    if not commands:
        status = "No RJ commands provided. Connect rj_commands from the Program component to Commands."

    else:
        cache_id, model, mesh_cache = find_latest_startup_cache()

        if model is None:
            raise Exception("No cached robot model found. Run the Startup component first.")

        tool_link = choose_tool_link(model)

        if not tool_link:
            raise Exception("Could not identify a tool/end-effector link.")

        poses, tool_z, track_length_mm, track_firmware_inverted, program_state = load_program_pose_sequence(commands)
        display_scale = get_display_scale(program_state)
        # tool_z is stored in model meters; convert for display-plane offsets.
        tool_z_display = tool_z * display_scale

        parsed = [p for p in poses if p.get("valid")]

        if not parsed:
            status = "Commands were provided, but no valid URDF poses or RJ parses were available."

        else:
            # Prefer full pose list aligned to commands (including invalid slots skipped above).
            # Re-index against all poses that are valid; keep command list length for Time.
            pose_by_command = poses

            # Determine active command index.
            t = to_float(Time, 0.0)

            if len(commands) == 1:
                active_index = 0

            elif 0.0 <= t <= 1.0:
                active_index = int(round(t * (len(commands) - 1)))
                active_index = int(clamp(active_index, 0, len(commands) - 1))

            else:
                active_index = int(round(t))
                active_index = int(clamp(active_index, 0, len(commands) - 1))

            # Build TCP planes for all commands that have valid poses.
            # FK is in meters; scale to Rhino mm for overlay with authored targets.
            tcp_points = []

            for p in pose_by_command:
                if not p.get("valid"):
                    tcp_planes.append(rg.Plane.Unset)
                    continue

                config = make_config(
                    model,
                    p["track_m"],
                    p["joints_rad"]
                )

                frame = safe_fk(model, config, tool_link)

                if frame is None:
                    tcp_planes.append(rg.Plane.Unset)
                    continue

                flange_plane = frame_to_plane(frame, display_scale)
                tcp_plane = offset_plane_along_z(flange_plane, tool_z_display)

                tcp_planes.append(tcp_plane)
                tcp_points.append(tcp_plane.Origin)

            if draw_path:
                tcp_path = make_path_curve(tcp_points)

            # Active state.
            active = pose_by_command[active_index]
            if not active.get("valid"):
                # Fall back to nearest valid pose.
                for j in range(len(pose_by_command)):
                    if pose_by_command[j].get("valid"):
                        active = pose_by_command[j]
                        active_index = j
                        break

            active_command = active.get("command")
            active_joint_values_deg = active.get("joints_deg", [])
            active_joint_values_rad = active.get("joints_rad", [])
            active_track_m = active.get("track_m", 0.0)
            active_j7_mm = active.get("j7_mm", 0.0)

            active_config = make_config(
                model,
                active_track_m,
                active_joint_values_rad
            )

            frame_by_link = get_frame_by_link(model, active_config)

            if draw_robot:
                robot_geometry = draw_robot_meshes(mesh_cache, frame_by_link, display_scale)

            if draw_track:
                track_geometry = draw_track_proxy(frame_by_link, display_scale)

            if draw_skeleton:
                skeleton_lines = draw_skeleton_lines(model, frame_by_link, display_scale)

            # Sticky target planes from Comp3 are stored in model meters.
            if draw_targets:
                target_planes = sc.sticky.get("AR4_LAST_PROGRAM_TARGET_PLANES", None)

                if not target_planes:
                    target_planes = tcp_planes
                    for pl in target_planes:
                        if isinstance(pl, rg.Plane):
                            target_geometry.extend(plane_marker(pl, 40.0))
                else:
                    for pl in target_planes:
                        if isinstance(pl, rg.Plane):
                            pl_disp = scale_plane_to_display(pl, display_scale)
                            target_geometry.extend(plane_marker(pl_disp, 40.0))

            meta_count = 0
            if sc is not None:
                meta = sc.sticky.get("AR4_LAST_PROGRAM_COMMAND_METADATA", None)
                if isinstance(meta, list):
                    meta_count = len(meta)

            simulation_state = {
                "cache_id": cache_id,
                "command_count": len(commands),
                "valid_pose_count": len(parsed),
                "metadata_count": meta_count,
                "active_index": active_index,
                "active_command": active_command,
                "active_track_m": active_track_m,
                "active_j7_mm": active_j7_mm,
                "active_joint_values_deg": active_joint_values_deg,
                "active_joint_values_rad": active_joint_values_rad,
                "active_pose_source": active.get("source"),
                "tool_link": tool_link,
                "tool_z_m": tool_z,
                "tool_z_display": tool_z_display,
                "display_scale": display_scale,
                "display_units": "mm" if abs(display_scale - 1000.0) < 1e-6 else "model",
                "track_firmware_inverted": track_firmware_inverted,
                "track_length_mm": track_length_mm,
                "pose_source_note": "URDF metadata preferred over RJ parse"
            }

            status = (
                "Simulation ready | "
                "active index {}/{} | "
                "source={} | "
                "display_scale={} | "
                "TrackM {:.4f} | firmware J7 {:.3f} mm | "
                "robot geometry {} | path points {}"
            ).format(
                active_index,
                len(commands) - 1,
                active.get("source"),
                display_scale,
                active_track_m,
                active_j7_mm,
                len(robot_geometry),
                len(tcp_points)
            )

except Exception as e:
    active_index = -1
    active_command = None
    active_joint_values_deg = []
    active_joint_values_rad = []
    active_track_m = 0.0
    active_j7_mm = 0.0

    robot_geometry = []
    track_geometry = []
    tcp_planes = []
    tcp_path = None
    target_geometry = []
    skeleton_lines = []

    simulation_state = {}
    status = "ERROR: {}".format(e)
# ---------- end ar4_simulation ----------
panel_3 = Panel(ar4_startup.active_port)
panel_4 = Panel(ar4_startup.startup_state)
panel_5 = Panel(ar4_startup.status)
panel_6 = Panel(ar4_startup.robot_name)
panel_7 = Panel(ar4_calibration.calibration_state)
panel_8 = Panel(ar4_calibration.status)
panel_9 = Panel(ar4_calibration.joint_values_deg)
panel_10 = Panel(ar4_calibration.sent_command)
panel_11 = Panel(ar4_run.sent_commands)
panel_12 = Panel(ar4_run.completed)
preview = Preview(d1=ar4_simulation.robot_geometry, d2=ar4_simulation.track_geometry)  # -> R, C
panel_13 = Panel(ar4_run.status)
panel_14 = Panel(ar4_program.status)
panel_15 = Panel(ar4_program.ik_errors)
panel_16 = Panel(ar4_program.solved)
preview_2 = CustomPreview(Geometry=preview.R, Material=preview.C)
panel_17 = Panel(ar4_program.rj_commands)
deplane = DeconstructPlane(Plane=ar4_program.target_planes_robot)  # -> Origin, XAxis, YAxis, ZAxis
panel_18 = Panel(ar4_simulation.active_command)

# ==== cluster Preview
d1 = ClusterInput()
d2 = ClusterInput()
merge = Merge(Data1=d1, Data2=d2)
lng = ListLength(List=merge)
index = ItemIndex(List=merge, Item=merge)
remap = RemapNumbers(Value=index, Source=lng, Target=Domain(0, 1))  # -> Mapped, Clipped
gradient = Gradient(LowerLimit=0, UpperLimit=1, Parameter=remap.Mapped, stops=[0: RGB(255, 255, 255), 1: RGB(0, 0, 0)])
R = ClusterOutput(merge)
C = ClusterOutput(gradient)
